# Grasshopper definition robot_from_disk_rfl.ghx (Grasshopper 1.0.7)

reload = Button()

# ----
# Robot
load = Button()
python = PythonScript(load=load)  # -> robot
# ---------- python: Python ----------
from scriptcontext import sticky as st

import os
import compas

from compas.robots import RobotModel
from compas.robots.resources import LocalPackageMeshLoader

from compas_fab.robots import Robot
from compas_fab.robots import RobotSemantics
from compas_ghpython.artists import RobotModelArtist


# Robot meshes are usually in meters
# Set a high precision to prevent parsing errors
# and configure Rhino itself in meters
compas.PRECISION = '12f'

# Store robot in component-based key
robot_key = 'robot_{}'.format(str(ghenv.Component.InstanceGuid))

if robot_key not in st:
    st[robot_key] = None

if load:
    canvas = ghenv.Component.OnPingDocument()

    # Load robot
    urdf_folder = os.path.join(os.path.dirname(canvas.FilePath), '../../robots/rfl_description')
    urdf_file = os.path.join(urdf_folder, 'rfl_description', 'urdf', 'rfl_pybullet.urdf')
    srdf_file = os.path.join(urdf_folder, 'rfl_description', 'urdf', 'rfl.srdf')

    model = RobotModel.from_urdf_file(urdf_file)
    model.load_geometry(LocalPackageMeshLoader(urdf_folder, 'rfl_description'))
    semantics = RobotSemantics.from_srdf_file(srdf_file, model)

    artist = RobotModelArtist(model)
    robot = Robot(model, artist, semantics=semantics)

    st[robot_key] = robot

robot = st[robot_key]
# ---------- end python ----------
robot = Data(python)

robot_configuration = GhPythonScript(robot=python)  # -> out, zero_configuration
# ---------- robot_configuration: Python ----------
zero_configuration = robot.zero_configuration()
print(zero_configuration)

print('Joints in robot.get_configurable_joints():')
for joint in robot.get_configurable_joints(None):
    print ('%s (%s - %s)' % (joint.name, joint.limit.lower, joint.limit.upper))
# ---------- end robot_configuration ----------
py = PythonScript(reload=reload)
# ---------- py: Python ----------
if reload:
    from compas_ghpython import unload_modules
    unload_modules('compas')
# ---------- end py ----------
Y = Slider(-3, range=-9.65..0)
X = Slider(5, range=0..20)
Z = Slider(-2, range=-4.65..-1)

# ---- group: forward kinematics
# Configuration
a1 = Slider(0, range=-360..360)
a2 = Slider(0, range=-360..360)
a3 = Slider(0, range=-360..360)
a4 = Slider(0, range=-360..360)
a5 = Slider(0, range=-360..360)
a6 = Slider(0, range=-360..360)
forward_kinematics = PythonScript(
    robot=robot,
    bridge1_joint_EA_X=X,
    robot11_joint_EA_Y=Y,
    robot11_joint_EA_Z=Z,
    robot11_joint_1=a1,
    robot11_joint_2=a2,
    robot11_joint_3=a3,
    robot11_joint_4=a4,
    robot11_joint_5=a5,
    robot11_joint_6=a6)  # -> configuration
# ---------- forward_kinematics: Python ----------
import math
from compas.robots import Configuration

if robot:
    joint_values = [
        bridge1_joint_EA_X,
        robot11_joint_EA_Y,
        robot11_joint_EA_Z,
        math.radians(robot11_joint_1),
        math.radians(robot11_joint_2),
        math.radians(robot11_joint_3),
        math.radians(robot11_joint_4),
        math.radians(robot11_joint_5),
        math.radians(robot11_joint_6),
        ]
        
    joint_names = [
        'bridge1_joint_EA_X',
        'robot11_joint_EA_Y',
        'robot11_joint_EA_Z',
        'robot11_joint_1',
        'robot11_joint_2',
        'robot11_joint_3',
        'robot11_joint_4',
        'robot11_joint_5',
        'robot11_joint_6',
        ]
    configuration = Configuration.from_prismatic_and_revolute_values(joint_values[0:3],joint_values[3:], joint_names)
# ---------- end forward_kinematics ----------

# ----
panel = Panel(robot_configuration.out)
merge = GhPythonScript(configuration_old=robot_configuration.zero_configuration, configuration_new=forward_kinematics)  # -> out, configuration_merged
# ---------- merge: Python ----------
configuration_merged = configuration_old.copy()
for key, value in configuration_new.items():
    print (key)
    configuration_merged[key] = value
# ---------- end merge ----------

# ----
# Visualisation
show_end_effector_frame = BooleanToggle(False)
show_base_frame = BooleanToggle(False)
show_collision = BooleanToggle(False)
show_frames = BooleanToggle(False)
show_visual = BooleanToggle(True)
visualize = PythonScript(
    robot=robot,
    configuration=merge.configuration_merged,
    show_visual=show_visual,
    show_collision=show_collision,
    show_frames=show_frames,
    show_base_frame=show_base_frame,
    show_end_effector_frame=show_end_effector_frame)  # -> visual, collision, frames, ee_frame, base_frame
# ---------- visualize: Python ----------
"""Visualizes a robot.
    Inputs:
        robot: The robot
        configuration: :class:`compas_fab.robots.Configuration`
            The robot's full configuration to display.
        show_visual: bool
           Whether or not to show the robot's visual meshes.
        show_collision: bool
           Whether or not to show the robot's collision meshes.
        show_frames: bool
           Whether or not to show the robot's joint frames.
        show_base_frame: bool
           Whether or not to show the robot's base frame.
        show_end_effector_frame: bool
            Whether or not to show the robot's end-effector frame.
    Output:
        visual: The robot's visual meshes.
        collision: The robot's collision meshes.
        frames: The robot's joint frames.
        base_frame: The robot's base frame.
        ee_frame: The robot's end-effector frame.
"""
from __future__ import print_function

if robot and configuration:
    group = group or robot.main_group_name if robot.semantics else None

    robot.update(configuration, group, visual=show_visual, collision=show_collision)

    if show_visual:
        visual = robot.artist.draw_visual()

    if show_collision:
        collision = robot.artist.draw_collision()

    if show_frames:
        axes = robot.transformed_axes(configuration, group)
        frames = robot.transformed_frames(configuration, group)

    if show_base_frame:
        frames = robot.transformed_frames(configuration, group)
        base_frame = frames[0]

    if show_end_effector_frame:
        ee_frame = robot.forward_kinematics(configuration, group)
        print("End-effector", ee_frame)
# ---------- end visualize ----------
draw = GhPythonScript(frames=[visualize.frames, visualize.ee_frame, visualize.base_frame], scale=Slider(0.1, range=0..1))  # -> P, V, C, W; inputs frames: list
# ---------- draw: Python ----------
from System.Drawing import Color
from compas_ghpython.utilities import draw_frame

red = Color.FromArgb(255, 0, 0)
green = Color.FromArgb(0, 255, 0)
blue = Color.FromArgb(0, 0, 255)

P = []
V = []
C = []

scale = float(scale)

for frame in frames:
    if not frame:
        continue
    plane = draw_frame(frame)
    P += [plane.Origin] * 3
    V.append(plane.XAxis * scale)
    V.append(plane.YAxis * scale)
    V.append(plane.ZAxis * scale)
    C += [red, green, blue]

W = 3
# ---------- end draw ----------
geo = Geometry(visualize.collision)
geo_2 = Geometry(visualize.visual)
vdisex = VectorDisplayEx(Point=draw.P, Vector=draw.V, Colour=draw.C, Width=draw.W)
