# Grasshopper definition analytical_IK_with_ur5.ghx (Grasshopper 1.0.7)

reload = Button()

# ----
# Robot
load = Button()
python = PythonScript(load=load)  # -> robot
# ---------- python: Python ----------
from scriptcontext import sticky as st

import os
import compas

from compas.robots import RobotModel
from compas.robots.resources import LocalPackageMeshLoader

#from compas_fab.robots import Robot
from compas_fab.robots.ur5 import Robot
from compas_fab.robots import RobotSemantics
from compas_ghpython.artists import RobotModelArtist

from compas_fab.backends import AnalyticalInverseKinematics

# Robot meshes are usually in meters
# Set a high precision to prevent parsing errors
# and configure Rhino itself in meters
compas.PRECISION = '12f'

# Store robot in component-based key
robot_key = 'robot_{}'.format(str(ghenv.Component.InstanceGuid))

if robot_key not in st:
    st[robot_key] = None

if load:
    robot = Robot(client=AnalyticalInverseKinematics, load_geometry=True)
    robot.artist = RobotModelArtist(robot.model)

    st[robot_key] = robot

robot = st[robot_key]
# ---------- end python ----------
robot = Data(python)

py = PythonScript(reload=reload)
# ---------- py: Python ----------
if reload:
    from compas_ghpython import unload_modules
    unload_modules('compas')
# ---------- end py ----------

# ----
# Target Frame
number_slider = Slider(0.3, range=-1..1)
pt = ConstructPoint(XCoordinate=Slider(0, range=-1..1), YCoordinate=Slider(0.3, range=-1..1), ZCoordinate=number_slider)
xy = XYPlane(Origin=pt)

# ----
# Analytical IK
solution_number = Slider(0, range=0..7)
python_2 = GhPythonScript(robot=robot, target_frame=xy)  # -> out, configurations
# ---------- python_2: Python ----------
from compas_fab.backends import AnalyticalInverseKinematics
from compas_rhino.geometry import RhinoPlane
from compas.robots import Configuration

ik = AnalyticalInverseKinematics()

frame_WCF = RhinoPlane.from_geometry(target_frame).to_compas_frame()
configurations = []
for jp, jn in ik.inverse_kinematics(robot, frame_WCF, options={'solver': 'ur5', 'keep_order' : True}):
    print(jn)
    configurations.append(Configuration.from_revolute_values(jp,jn))
# ---------- end python_2 ----------
item = ListItem(List=python_2.configurations, Index=solution_number, Wrap=True)

# ----
# Visualisation
show_end_effector_frame = BooleanToggle(False)
show_base_frame = BooleanToggle(False)
show_collision = BooleanToggle(False)
show_frames = BooleanToggle(True)
show_visual = BooleanToggle(True)
visualize = PythonScript(
    robot=robot,
    configuration=item,
    show_visual=show_visual,
    show_collision=show_collision,
    show_frames=show_frames,
    show_base_frame=show_base_frame,
    show_end_effector_frame=show_end_effector_frame)  # -> visual, collision, frames, ee_frame, base_frame
# ---------- visualize: Python ----------
"""Visualizes a robot.
    Inputs:
        robot: The robot
        configuration: :class:`compas_fab.robots.Configuration`
            The robot's full configuration to display.
        show_visual: bool
           Whether or not to show the robot's visual meshes.
        show_collision: bool
           Whether or not to show the robot's collision meshes.
        show_frames: bool
           Whether or not to show the robot's joint frames.
        show_base_frame: bool
           Whether or not to show the robot's base frame.
        show_end_effector_frame: bool
            Whether or not to show the robot's end-effector frame.
    Output:
        visual: The robot's visual meshes.
        collision: The robot's collision meshes.
        frames: The robot's joint frames.
        base_frame: The robot's base frame.
        ee_frame: The robot's end-effector frame.
"""
from __future__ import print_function

if robot and configuration:
    group = group or robot.main_group_name if robot.semantics else None

    robot.update(configuration, group, visual=show_visual, collision=show_collision)

    if show_visual:
        visual = robot.artist.draw_visual()

    if show_collision:
        collision = robot.artist.draw_collision()

    if show_frames:
        axes = robot.transformed_axes(configuration, group)
        frames = robot.transformed_frames(configuration, group)

    if show_base_frame:
        frames = robot.transformed_frames(configuration, group)
        base_frame = frames[0]

    if show_end_effector_frame:
        ee_frame = robot.forward_kinematics(configuration, group)
        print("End-effector", ee_frame)
# ---------- end visualize ----------
geo = Geometry(visualize.visual)
geo_2 = Geometry(visualize.collision)
item_2 = ListItem(List=visualize.frames, Index=-1, Wrap=True)
draw = GhPythonScript(frames=item_2, scale=Slider(0.1, range=0..1))  # -> P, V, C, W; inputs frames: list
# ---------- draw: Python ----------
from System.Drawing import Color
from compas_ghpython.utilities import draw_frame

red = Color.FromArgb(255, 0, 0)
green = Color.FromArgb(0, 255, 0)
blue = Color.FromArgb(0, 0, 255)

P = []
V = []
C = []

scale = float(scale)

for frame in frames:
    if not frame:
        continue
    plane = draw_frame(frame)
    P += [plane.Origin] * 3
    V.append(plane.XAxis * scale)
    V.append(plane.YAxis * scale)
    V.append(plane.ZAxis * scale)
    C += [red, green, blue]

W = 3
# ---------- end draw ----------
preview = CustomPreview(Geometry=geo, Material=ColourSwatch(SwatchColor=RGB(148, 120, 120)))
vdisex = VectorDisplayEx(Point=draw.P, Vector=draw.V, Colour=draw.C, Width=draw.W)
