# Grasshopper definition FMP_GoFa_abb_crb15000.ghx (Grasshopper 1.0.7)

reload = Button()

# ----
# Robot
load = Button()
python = PythonScript(load=load)  # -> robot
# ---------- python: Python ----------
from scriptcontext import sticky as st

import os
import compas

from compas.robots import RobotModel
from compas.robots.resources import LocalPackageMeshLoader

from compas_fab.robots import Robot
from compas_fab.robots import RobotSemantics
from compas_ghpython.artists import RobotModelArtist


# Robot meshes are usually in meters
# Set a high precision to prevent parsing errors
# and configure Rhino itself in meters
compas.PRECISION = '12f'

# Store robot in component-based key
robot_key = 'robot_{}'.format(str(ghenv.Component.InstanceGuid))

if robot_key not in st:
    st[robot_key] = None

if load:
    canvas = ghenv.Component.OnPingDocument()

    # Load robot
    package_folder = os.path.join(os.path.dirname(canvas.FilePath), '../../robots')
    urdf_file = os.path.join(package_folder, 'abb_crb15000_support', 'urdf', 'crb15000_5_95.urdf')


    model = RobotModel.from_urdf_file(urdf_file)
    model.load_geometry(LocalPackageMeshLoader(package_folder, 'abb_crb15000_support'))


    artist = RobotModelArtist(model)
#    robot = Robot(model, artist, semantics=semantics)
    robot = Robot(model, artist)

    st[robot_key] = robot

robot = st[robot_key]
# ---------- end python ----------
robot = Data(python)

py = PythonScript(reload=reload)
# ---------- py: Python ----------
if reload:
    from compas_ghpython import unload_modules
    unload_modules('compas')
# ---------- end py ----------

# ---- group: forward kinematics
# Target Configuration
a1 = Slider(-63, range=-360..360)
a2 = Slider(75, range=-360..360)
a3 = Slider(-86, range=-360..360)
a4 = Slider(-130, range=-360..360)
a5 = Slider(0, range=-360..360)
a6 = Slider(0, range=-360..360)
forward_kinematics = PythonScript(robot=robot, joint_1=a1, joint_2=a2, joint_3=a3, joint_4=a4, joint_5=a5, joint_6=a6)  # -> configuration
# ---------- forward_kinematics: Python ----------
import math
from compas.robots import Configuration

if robot:
    joint_values = [
        math.radians(joint_1),
        math.radians(joint_2),
        math.radians(joint_3),
        math.radians(joint_4),
        math.radians(joint_5),
        math.radians(joint_6),
        ]
        
    joint_names = [
        'joint_1',
        'joint_2',
        'joint_3',
        'joint_4',
        'joint_5',
        'joint_6',
        ]
    configuration = Configuration.from_prismatic_and_revolute_values(joint_values[0:3],joint_values[3:], joint_names)
# ---------- end forward_kinematics ----------

# ----
# Collision Geometry
fixed_collision_lock_geometry_brep = Brep([<brep referenced from the Rhino model> x4])
user_defined_collision_geometry_brep = Brep(<brep referenced from the Rhino model>)
mesh = MeshBrep(
    Brep=[fixed_collision_lock_geometry_brep, user_defined_collision_geometry_brep],
    Settings={GridMaxCount=0, GridMinCount=16, JaggedSeams=False, MaxEdgeLength=0, MinEdgeLength=0.0001, MinTolerance=0, Refine=True, RefineAngle=0, RelativeTolerance=0.65, SimplePlanes=True, Tolerance=0})
tri = Triangulate(Mesh=mesh)  # -> Mesh, Count

# ----
# Initial Config
num_0 = Number(0)
num_0_2 = Number(0)
num_0_3 = Number(0)
num_0_4 = Number(0)
num_0_5 = Number(90)
num_0_6 = Number(0)
forward_kinematics_2 = PythonScript(robot=robot, joint_1=num_0, joint_2=num_0_2, joint_3=num_0_3, joint_4=num_0_4, joint_5=num_0_5, joint_6=num_0_6)  # -> configuration; inputs joint_1: Int32; same code as forward_kinematics

start_configuration = Panel(forward_kinematics_2)
end_configuration = Panel(forward_kinematics)

# ----
# Save to JSON File
python_2 = GhPythonScript(collision_meshes=tri.Mesh, start_configuration=forward_kinematics_2, end_configuratoion=forward_kinematics)  # -> out, json_file_path; inputs collision_meshes: list of Mesh
# ---------- python_2: Python ----------
import os
from compas.data import json_dump
from Rhino.RhinoDoc import ActiveDoc
from compas_rhino.geometry import RhinoMesh

canvas = ghenv.Component.OnPingDocument()

folder = os.path.dirname(canvas.FilePath)
filename = 'free_motion_request.json'
json_file_path = folder + os.path.sep + filename


data_dict = {}
data_dict['collision_meshes'] = [RhinoMesh.from_geometry(mesh).to_compas() for mesh in collision_meshes]
data_dict['start_configuration'] = start_configuration
data_dict['end_configuration'] = end_configuratoion

json_dump(data_dict, json_file_path, True)
# ---------- end python_2 ----------

# ----
# Load Result from JSON File
number_slider = Slider(0, range=0..1)
python_3 = GhPythonScript(y=Button())  # -> out, json_file_path, trajectory
# ---------- python_3: Python ----------
import os
from compas.data import json_load
from Rhino.RhinoDoc import ActiveDoc
from compas_rhino.geometry import RhinoMesh

canvas = ghenv.Component.OnPingDocument()

folder = os.path.dirname(canvas.FilePath)
filename = 'free_motion_result.json'
json_file_path = folder + os.path.sep + filename

trajectory = json_load(json_file_path)
# ---------- end python_3 ----------
planned_trajectory = GhPythonScript(trajectory=python_3.trajectory, config_index_progress=number_slider)  # -> out, configuration
# ---------- planned_trajectory: Python ----------
import math
print trajectory
number_of_traj_points = len(trajectory.points)
conf_index = min(int(math.floor(config_index_progress * number_of_traj_points)), number_of_traj_points - 1)
configuration = trajectory.points[conf_index]
# ---------- end planned_trajectory ----------

# ----
# Visualisation
can_only_visualize_one_at_a_time = ValueList({"Jogging Configuration": 0, "Start Configuration": 1, "End Configuration": 2, "Trajectory Configuration": 3}, selected="End Configuration")
trajectory_configuration = Data(planned_trajectory.configuration)
jogging_configuration = Data(forward_kinematics)
start_configuration_2 = Data(forward_kinematics_2)
end_configuration_2 = Data(forward_kinematics)
filter = StreamFilter(
    Gate=can_only_visualize_one_at_a_time,
    Stream0=jogging_configuration,
    Stream1=start_configuration_2,
    Stream2=end_configuration_2,
    Stream3=trajectory_configuration)
show_end_effector_frame = BooleanToggle(False)
show_base_frame = BooleanToggle(False)
show_collision = BooleanToggle(False)
show_frames = BooleanToggle(False)
show_visual = BooleanToggle(True)
visualize = PythonScript(
    robot=robot,
    configuration=filter,
    show_visual=show_visual,
    show_collision=show_collision,
    show_frames=show_frames,
    show_base_frame=show_base_frame,
    show_end_effector_frame=show_end_effector_frame)  # -> visual, collision, frames, ee_frame, base_frame
# ---------- visualize: Python ----------
"""Visualizes a robot.
    Inputs:
        robot: The robot
        configuration: :class:`compas_fab.robots.Configuration`
            The robot's full configuration to display.
        show_visual: bool
           Whether or not to show the robot's visual meshes.
        show_collision: bool
           Whether or not to show the robot's collision meshes.
        show_frames: bool
           Whether or not to show the robot's joint frames.
        show_base_frame: bool
           Whether or not to show the robot's base frame.
        show_end_effector_frame: bool
            Whether or not to show the robot's end-effector frame.
    Output:
        visual: The robot's visual meshes.
        collision: The robot's collision meshes.
        frames: The robot's joint frames.
        base_frame: The robot's base frame.
        ee_frame: The robot's end-effector frame.
"""
from __future__ import print_function

if robot and configuration:
    group = group or robot.main_group_name if robot.semantics else None

    robot.update(configuration, group, visual=show_visual, collision=show_collision)

    if show_visual:
        visual = robot.artist.draw_visual()

    if show_collision:
        collision = robot.artist.draw_collision()

    if show_frames:
        axes = robot.transformed_axes(configuration, group)
        frames = robot.transformed_frames(configuration, group)

    if show_base_frame:
        frames = robot.transformed_frames(configuration, group)
        base_frame = frames[0]

    if show_end_effector_frame:
        ee_frame = robot.forward_kinematics(configuration, group)
        print("End-effector", ee_frame)
# ---------- end visualize ----------
draw = GhPythonScript(frames=[visualize.frames, visualize.ee_frame, visualize.base_frame], scale=Slider(0.1, range=0..1))  # -> P, V, C, W; inputs frames: list
# ---------- draw: Python ----------
from System.Drawing import Color
from compas_ghpython.utilities import draw_frame

red = Color.FromArgb(255, 0, 0)
green = Color.FromArgb(0, 255, 0)
blue = Color.FromArgb(0, 0, 255)

P = []
V = []
C = []

scale = float(scale)

for frame in frames:
    if not frame:
        continue
    plane = draw_frame(frame)
    P += [plane.Origin] * 3
    V.append(plane.XAxis * scale)
    V.append(plane.YAxis * scale)
    V.append(plane.ZAxis * scale)
    C += [red, green, blue]

W = 3
# ---------- end draw ----------
geo = Geometry(visualize.collision)
geo_2 = Geometry(visualize.visual)
vdisex = VectorDisplayEx(Point=draw.P, Vector=draw.V, Colour=draw.C, Width=draw.W)

# ----
# Visualisation Flange Frame Trace
python_4 = GhPythonScript(trajectory=python_3.trajectory, robot=robot)  # -> out, ee_frames_gh
# ---------- python_4: Python ----------
from compas_ghpython.utilities import draw_frame

ee_frames_gh = []
for conf in trajectory.points:
    ee_frame = robot.forward_kinematics(conf, None)
    ee_frames_gh.append(draw_frame(ee_frame))
# ---------- end python_4 ----------
pline = PolyLine(Vertices=python_4.ee_frames_gh, Closed=False)
