# Grasshopper definition 01_SimpleAssemblyVisualization.gh (Grasshopper 1.0.7)

workpiece_brep = Brep([<brep referenced from the Rhino model> x8])
assembly_step = Slider(7, range=0..8)
brep_tool_geometry = Brep([<brep referenced from the Rhino model> x3])
tool_frame_srf = Surface(<surface referenced from the Rhino model>)
tool_frame_on_workpieces_srf = Surface([<surface referenced from the Rhino model> x8])
pln = Plane(tool_frame_srf)
pln_2 = Plane(tool_frame_on_workpieces_srf)
group = Group(Objects=brep_tool_geometry)
orient = Orient(Geometry=group, Source=pln, Target=pln_2)  # -> Geometry, Transform
item = ListItem(List=workpiece_brep, Index=assembly_step, Wrap=False)
split = SplitList(List=workpiece_brep, Index=assembly_step)  # -> ListA, ListB
item_2 = ListItem(List=orient.Geometry, Index=assembly_step, Wrap=False)
previous_workpiece = Brep(split.ListA)
current_workpiece = Brep(item)
gripper = Data(item_2)
# Workpiece (Current)
preview = CustomPreview(Geometry=current_workpiece, Material=ColourSwatch(SwatchColor=RGB(152, 186, 141)))
# Workpiece
preview_2 = CustomPreview(Geometry=previous_workpiece, Material=ColourSwatch(SwatchColor=RGB(112, 122, 109)))
# Gripper Tool
preview_3 = CustomPreview(Geometry=gripper, Material=ColourSwatch(SwatchColor=RGB(102, 124, 196)))
