# Grasshopper definition 02_AssemblyVisualizationSubSteps.gh (Grasshopper 1.0.7)

# ----
# Workpiece Geoemtry
workpieces_brep = Brep([<brep referenced from the Rhino model> x8])

# ----
# Grasp Definition (Workpiece Origin)
tool_frame_on_workpieces_srf = Surface([<surface referenced from the Rhino model> x8])
tool_frame_on_workpieces_pln = Plane(tool_frame_on_workpieces_srf)

# ----
# Workpiece Pickup Location
pickup_tool_tip_frame_srf = Surface(<surface referenced from the Rhino model>)
pickup_tool_tip_frame_pln = Plane(pickup_tool_tip_frame_srf)

# ----
# Tool Definition
brep_tool_geometry = Brep([<brep referenced from the Rhino model> x4])
tool_frame_srf = Surface(<surface referenced from the Rhino model>)
tool_frame_pln = Plane(tool_frame_srf)
group = Group(Objects=brep_tool_geometry)

# ----
# Approach / Retract Direction
approach_direction_crv = Curve([<curve referenced from the Rhino model> x8])
retract_direction_crv = Curve([<curve referenced from the Rhino model> x8])
end = EndPoints(Curve=approach_direction_crv)  # -> Start, End
end_2 = EndPoints(Curve=retract_direction_crv)  # -> Start, End
vec2pt = Vector2Pt(PointA=end.Start, PointB=end.End, Unitize=False)  # -> Vector, Length
vec2pt_2 = Vector2Pt(PointA=end_2.Start, PointB=end_2.End, Unitize=False)  # -> Vector, Length

# ----
# Visualization Control (Step / Sub step)
step_to_visualize = Slider(13, range=0..32)
integer_division = IntegerDivision(A=step_to_visualize, B="4")
mod = Modulus(A=step_to_visualize, B="4")
sub_step = Panel(mod)
step = Panel(integer_division)

tool_frame_on_workpieces_pln_2 = Plane(tool_frame_on_workpieces_pln)
approach_direction_vec = Vector(vec2pt.Vector)
retract_direction_vec = Vector(vec2pt_2.Vector)
orient = Orient(Geometry=group, Source=tool_frame_pln, Target=tool_frame_on_workpieces_pln)  # -> Geometry, Transform
visualization_step_number = Integer(step)
visualization_sub_step_number = Integer(sub_step)
visualization_step_number_2 = Integer(visualization_step_number)
visualization_step_number_3 = Integer(visualization_step_number)
orient_2 = Orient(Geometry=workpieces_brep, Source=tool_frame_on_workpieces_pln_2, Target=PlaneXY(0, 0, 0))  # -> Geometry, Transform
visualization_step_number_4 = Integer(visualization_step_number)
workpieces_brep_2 = Brep(workpieces_brep)
item = ListItem(List=orient.Geometry, Index=visualization_step_number_2, Wrap=False)
visualization_step_number_5 = Integer(visualization_step_number)
orient_3 = Orient(Geometry=orient_2.Geometry, Source=PlaneXY(0, 0, 0), Target=pickup_tool_tip_frame_pln)  # -> Geometry, Transform
orient_4 = Orient(Geometry=group, Source=tool_frame_pln, Target=pickup_tool_tip_frame_pln)  # -> Geometry, Transform
item_2 = ListItem(List=workpieces_brep_2, Index=visualization_step_number_4, Wrap=False)
item_3 = ListItem(List=retract_direction_vec, Index=visualization_step_number_3, Wrap=False)
item_4 = ListItem(List=approach_direction_vec, Index=visualization_step_number_3, Wrap=False)
gripper = Data(item)
rev = Reverse(Vector=item_4)
item_5 = ListItem(List=orient_3.Geometry, Index=visualization_step_number_5, Wrap=False)
current_workpiece = Brep(item_2)

# ----
# SubStep 2 : Before Approach
move = Move(Geometry=current_workpiece, Motion=rev)  # -> Geometry, Transform
move_2 = Move(Geometry=gripper, Motion=rev)  # -> Geometry, Transform

# ----
# SubStep 4 : After Retract
move_3 = Move(Geometry=gripper, Motion=item_3)  # -> Geometry, Transform
current_workpiece_2 = Brep(item_2)

# ----
# SubStep 1 : Pick up
current_part = Brep(item_5)
gripper_2 = Data(orient_4.Geometry)

# ----
# SubStep 3 : Assembled
gripper_3 = Data(gripper)
current_workpiece_3 = Brep(item_2)

# ----
# Workpiece (Previous)
visualization_step_number_6 = Integer(visualization_step_number)
workpieces_brep_3 = Brep(workpieces_brep)
split = SplitList(List=workpieces_brep_3, Index=visualization_step_number_6)  # -> ListA, ListB
previous_workpiece = Brep(split.ListA)
preview = CustomPreview(Geometry=previous_workpiece, Material=ColourSwatch(SwatchColor=RGB(112, 122, 109)))

visualization_sub_step_number_2 = Integer(visualization_sub_step_number)

# ----
# Workpiece (Current)
merge = Merge(Data1=current_part, Data2=move.Geometry, Data3=current_workpiece_3, Data4=current_workpiece_2)
item_6 = ListItem(List=merge, Index=visualization_sub_step_number_2, Wrap=True)
preview_2 = CustomPreview(Geometry=item_6, Material=ColourSwatch(SwatchColor=RGB(152, 186, 141)))

# ----
# Gripper Tool
merge_2 = Merge(Data1=gripper_2, Data2=move_2.Geometry, Data3=gripper_3, Data4=move_3.Geometry)
item_7 = ListItem(List=merge_2, Index=visualization_sub_step_number_2, Wrap=True)
preview_3 = CustomPreview(Geometry=item_7, Material=ColourSwatch(SwatchColor=RGB(102, 124, 196)))
