# Grasshopper definition 04_TrajectoryVisualization.gh (Grasshopper 1.0.7)

# ----
# Tool Definition
brep_tool_geometry = Brep([<brep referenced from the Rhino model> x4])
group = Group(Objects=brep_tool_geometry)

# ----
# Load Planned Process.JSON
load = Button()
gh_path = GhPythonScript(filename="process")  # -> folder, json_path
# ---------- gh_path: Python ----------
from Rhino.RhinoDoc import ActiveDoc
import os

canvas = ghenv.Component.OnPingDocument()

folder = os.path.dirname(canvas.FilePath)
if filename:
    json_path = folder + os.path.sep + filename +".json"
# ---------- end gh_path ----------
load_compas_json = GhPythonScript(json_path=gh_path.json_path, trigger=load)  # -> out, process
# ---------- load_compas_json: Python ----------
from compas.utilities import DataDecoder, DataEncoder
import json
with open(json_path, 'r') as f:
    process = json.load(f, cls=DataDecoder)
# ---------- end load_compas_json ----------

# ----
# Workpiece Geoemtry
workpieces_brep = Brep([<brep referenced from the Rhino model> x8])

# ----
# Grasp Definition (Workpiece Origin)
tool_frame_on_workpieces_srf = Surface([<surface referenced from the Rhino model> x8])
tool_frame_on_workpieces_pln = Plane(tool_frame_on_workpieces_srf)

# ----
# Load Robot
load_2 = Button()
python = PythonScript(load=load_2)  # -> robot
# ---------- python: Python ----------
from scriptcontext import sticky as st

import os
import compas

from compas.robots import RobotModel
from compas.robots.resources import LocalPackageMeshLoader

from compas_fab.robots import Robot
from compas_fab.robots import RobotSemantics
from compas_ghpython.artists import RobotModelArtist


# Robot meshes are usually in meters
# Set a high precision to prevent parsing errors
# and configure Rhino itself in meters
compas.PRECISION = '12f'

# Store robot in component-based key
robot_key = 'robot_{}'.format(str(ghenv.Component.InstanceGuid))

if robot_key not in st:
    st[robot_key] = None

if load:
    canvas = ghenv.Component.OnPingDocument()

    # Load robot
    package_folder = os.path.join(os.path.dirname(canvas.FilePath), '../../robots')
    urdf_file = os.path.join(package_folder, 'abb_crb15000_support', 'urdf', 'crb15000_5_95.urdf')
    srdf_file = os.path.join(package_folder, 'abb_crb15000_support', 'srdf', 'crb15000_5_95.srdf')

    model = RobotModel.from_urdf_file(urdf_file)
    model.load_geometry(LocalPackageMeshLoader(package_folder, 'abb_crb15000_support'))
    
    semantics = RobotSemantics.from_srdf_file(srdf_file, model)

    artist = RobotModelArtist(model)
    robot = Robot(model, artist, semantics=semantics)
#    robot = Robot(model, artist)

    st[robot_key] = robot

robot = st[robot_key]
# ---------- end python ----------
robot = Data(python)

# ----
# Visualize Process
number_slider = Slider(0, range=0..1)
python_2 = GhPythonScript(process=load_compas_json.process, vis=number_slider)  # -> out, state_i, config_i
# ---------- python_2: Python ----------
from compas_fab.planning import RoboticMovement
import math

print (len(process.actions))

state_index = []
config_index = []
for i, action in enumerate(process.actions):
    if isinstance(action, RoboticMovement):
        if action.planned_trajectory is not None:
            for t in range (len(action.planned_trajectory.points)):
                state_index.append(i)
                config_index.append(t)
    else:
        state_index.append(i)
        config_index.append(0)
        
total_steps = len(state_index)
print(total_steps)
vis_index = int(min(math.floor(vis * total_steps), total_steps - 1))
state_i = state_index[vis_index]
config_i = config_index[vis_index]
# ---------- end python_2 ----------
state_index = Panel(python_2.state_i)

python_3 = GhPythonScript(reload=Button(), module_names="compas_fab")  # -> out; inputs module_names: list
# ---------- python_3: Python ----------
#from compas_ghpython import unload_modules
#
#if reload:
#    for module_name in module_names:
#        unload_modules(module_name)

from compas_ghpython import unload_modules

unload_modules('compas_fab')
# ---------- end python_3 ----------
panel = Panel(python_3)

# ----
# Define Workpiece (Mesh / ID)
workpieces_brep_2 = Brep(workpieces_brep)
lng = ListLength(List=workpieces_brep_2)
orient = Orient(Geometry=workpieces_brep_2, Source=tool_frame_on_workpieces_pln, Target=PlaneXY(0, 0, 0))  # -> Geometry, Transform
series = Series(Start=0, Step=1, Count=lng)
int = Integer(series)
concat = Concatenate(FragmentA="b", FragmentB=int)
beam_ids = Text(concat)

# ----
# Action
planned_trajectory = GhPythonScript(process=load_compas_json.process, action_index=python_2.state_i, conf_index=python_2.config_i)  # -> out, action_type, allowed_collision_pairs, is_robotic_movement, has_planned_trajectory, configuration; inputs action_index: Int32, conf_index: Int32
# ---------- planned_trajectory: Python ----------
import math
from compas_fab.planning import RoboticMovement

action_index = min(len(process.actions) -1 , action_index)
action = process.actions[action_index]
action_type = action.__class__.__name__
is_robotic_movement = isinstance(action, RoboticMovement)
if is_robotic_movement:
    allowed_collision_pairs = [str(p) for p in action.allowed_collision_pairs]
    has_planned_trajectory = action.planned_trajectory is not None
    if has_planned_trajectory:
        number_of_traj_points = len(action.planned_trajectory.points)
        print("Trajectory Point {} of {}".format(conf_index + 1,number_of_traj_points))
        
        configuration = action.planned_trajectory.points[conf_index]
else:
    has_planned_trajectory = False
# ---------- end planned_trajectory ----------
has_planned_trajectory = Panel(planned_trajectory.has_planned_trajectory)
allowed_collision_pairs = Panel(planned_trajectory.allowed_collision_pairs)
action_type = Panel(planned_trajectory.action_type)
is_robotic_movement = Panel(planned_trajectory.is_robotic_movement)

# ----
# Amination Rotation
number_slider_2 = Slider(1, range=0..10)
rotate_viewport = GhPythonScript(x=python_2.state_i, rotate=Toggle(True), step_size=number_slider_2)  # -> out, a
# ---------- rotate_viewport: Python ----------
import rhinoscriptsyntax as rs
import Rhino

if rotate:
    viewPort = rs.CurrentView()
    rs.RotateView(viewPort, 0, step_size)
# ---------- end rotate_viewport ----------

has_planned_trajectory_2 = Boolean(planned_trajectory.has_planned_trajectory)

# ----
# Visualize SceneState after applying Actions
process = Data(load_compas_json.process)
beam_ids_2 = Text(beam_ids)
intermediate_state = GhPythonScript(process=process, state_index=python_2.state_i)  # -> out, scene_state, robot_state, tool_state, workpiece_states; inputs state_index: Int32
# ---------- intermediate_state: Python ----------
state_index = min(len(process.actions), state_index)
scene_state = process.get_intermediate_state(state_index)

robot_state = scene_state.get_robot_state()
tool_state = scene_state.get_tool_state()
workpiece_states = [scene_state.get_workpiece_state(id) for id in scene_state.workpiece_ids]
# ---------- end intermediate_state ----------
de_toolstate = GhPythonScript(tool_state=intermediate_state.tool_state)  # -> out, frame, frame_gh, configuration, attached_to_robot, attached_to_robot_grasp
# ---------- de_toolstate: Python ----------
from compas_ghpython.artists import FrameArtist
from compas.geometry import Transformation, Frame
frame  = tool_state.frame
frame_gh = FrameArtist(frame).draw()

configuration = tool_state.configuration
attached_to_robot = tool_state.attached_to_robot
if attached_to_robot:
    attached_to_robot_grasp = FrameArtist(Frame.from_transformation(tool_state.attached_to_robot_grasp)).draw()
# ---------- end de_toolstate ----------
de_robotstate = GhPythonScript(robot_state=intermediate_state.robot_state)  # -> out, frame, frame_gh, configuration
# ---------- de_robotstate: Python ----------
from compas_ghpython.artists import FrameArtist

frame  = robot_state.frame
configuration = robot_state.configuration


frame_gh = FrameArtist(frame).draw()
# ---------- end de_robotstate ----------
tool_geometry_group = Data(group)
workpieces_brep_3 = Brep(orient.Geometry)
orient_2 = Orient(Geometry=tool_geometry_group, Source=PlaneXY(0, 0, 0), Target=de_toolstate.frame_gh)  # -> Geometry, Transform

filter = StreamFilter(
    Gate=planned_trajectory.has_planned_trajectory,
    Stream0=de_robotstate.configuration,
    Stream1=planned_trajectory.configuration)
sort = GhPythonScript(workpiece_states=intermediate_state.workpiece_states, workpiece_ids=beam_ids_2)  # -> out, sorted; inputs workpiece_states: list, workpiece_ids: list
# ---------- sort: Python ----------
def find_by_id(id):
    for workpiece_state in workpiece_states:
        if workpiece_state.workpiece_id == id:
            return workpiece_state
    return None

sorted = []
for workpiece_id in workpiece_ids:
    workpiece_state = find_by_id(workpiece_id)
    if workpiece_state is not None:
        sorted.append(workpiece_state)
# ---------- end sort ----------

# ----
# Visualize Initial Config
show_end_effector_frame = BooleanToggle(True)
show_visual = BooleanToggle(True)
not = GateNot(A=show_visual)
visualize = PythonScript(
    robot=robot,
    group="manipulator",
    configuration=filter,
    show_visual=show_visual,
    show_collision=not,
    show_end_effector_frame=show_end_effector_frame)  # -> visual, collision, frames, ee_frame, base_frame, ee_frame_rhino
# ---------- visualize: Python ----------
"""Visualizes a robot.
    Inputs:
        robot: The robot
        configuration: :class:`compas_fab.robots.Configuration`
            The robot's full configuration to display.
        show_visual: bool
           Whether or not to show the robot's visual meshes.
        show_collision: bool
           Whether or not to show the robot's collision meshes.
        show_frames: bool
           Whether or not to show the robot's joint frames.
        show_base_frame: bool
           Whether or not to show the robot's base frame.
        show_end_effector_frame: bool
            Whether or not to show the robot's end-effector frame.
    Output:
        visual: The robot's visual meshes.
        collision: The robot's collision meshes.
        frames: The robot's joint frames.
        base_frame: The robot's base frame.
        ee_frame: The robot's end-effector frame.
"""
from __future__ import print_function
from compas_ghpython.artists import FrameArtist

if robot and configuration:
    group = group or robot.main_group_name if robot.semantics else None

    robot.update(configuration, group, visual=show_visual, collision=show_collision)

    if show_visual:
        visual = robot.artist.draw_visual()

    if show_collision:
        collision = robot.artist.draw_collision()

    if show_frames:
        axes = robot.transformed_axes(configuration, group)
        frames = robot.transformed_frames(configuration, group)

    if show_base_frame:
        frames = robot.transformed_frames(configuration, group)
        base_frame = frames[0]

    if show_end_effector_frame:
        ee_frame = robot.forward_kinematics(configuration, group)
        ee_frame_rhino = FrameArtist(ee_frame).draw()
        print("End-effector", ee_frame)
# ---------- end visualize ----------
robot_2 = Geometry([visualize.collision, visualize.visual])
mcol = MeshColours(Mesh=robot_2, Colours=ColourSwatch(SwatchColor=RGB(194, 194, 194)))

# ----
# Visualize Flange Frame Trace
python_4 = GhPythonScript(process=process, robot=robot)  # -> out, ee_frames_all
# ---------- python_4: Python ----------
from compas_ghpython.utilities import draw_frame
from Grasshopper import DataTree
from System import Object 
from Grasshopper.Kernel.Data import GH_Path
from compas_fab.planning import RoboticMovement

ee_frames_all = DataTree[Object]()
if robot:
    if process:
        for i, action in enumerate(process.actions):
            if isinstance(action, RoboticMovement):
                trajectory = action.planned_trajectory
                ee_frames_gh = []
                for conf in trajectory.points:
                    ee_frame = robot.forward_kinematics(conf, None)
                    ee_frames_all.Add(draw_frame(ee_frame), GH_Path(i))
# ---------- end python_4 ----------
path = ConstructPath(Indices=python_2.state_i)
pline = PolyLine(Vertices=python_4.ee_frames_all, Closed=False)
branch = TreeBranch(Tree=pline, Path=path, MaintainPaths=True)

# ----
# Tool (Attached to Trajectory Point)
tool_geometry_group_2 = Data(group)
orient_3 = Orient(Geometry=tool_geometry_group_2, Source=PlaneXY(0, 0, 0), Target=visualize.ee_frame_rhino)  # -> Geometry, Transform
attached_tool = Geometry(orient_3.Geometry)

gripper_notrajectory = Geometry(orient_2.Geometry)
gripper_with_trajectory = Geometry(attached_tool)
filter_2 = StreamFilter(Gate=has_planned_trajectory_2, Stream0=gripper_notrajectory, Stream1=gripper_with_trajectory)

# ----
# Gripper Tool
swatch = ColourSwatch(SwatchColor=RGB(102, 124, 196))
preview = CustomPreview(Geometry=filter_2, Material=swatch)

de_workpiecestate = GhPythonScript(workpiece_state=sort.sorted)  # -> out, workpiece_id, frame, frame_gh, attached_to_tool_id, attached_to_tool_grasp
# ---------- de_workpiecestate: Python ----------
from compas_ghpython.artists import FrameArtist
from compas.geometry import Transformation, Frame

workpiece_id = workpiece_state.workpiece_id
frame  = workpiece_state.frame
frame_gh = FrameArtist(frame).draw()

attached_to_tool_id = workpiece_state.attached_to_tool_id

if attached_to_tool_id is not None:
    attached_to_tool_grasp = FrameArtist(Frame.from_transformation(workpiece_state.attached_to_tool_grasp)).draw()
# ---------- end de_workpiecestate ----------
null = NullItem(Item=de_workpiecestate.attached_to_tool_id)  # -> NullFlags, InvalidFlags, Description
dispatch = Dispatch(List=workpieces_brep_3, DispatchPattern=null.NullFlags)  # -> ListA, ListB

# ----
# Workpiece (Attached to Trajectory Point)
dispatch_2 = Dispatch(List=de_workpiecestate.attached_to_tool_grasp, DispatchPattern=null.NullFlags)  # -> ListA, ListB
orient_4 = Orient(Geometry=dispatch.ListB, Source=PlaneXY(0, 0, 0), Target=dispatch_2.ListB)  # -> Geometry, Transform
orient_5 = Orient(Geometry=orient_4.Geometry, Source=PlaneXY(0, 0, 0), Target=visualize.ee_frame_rhino)  # -> Geometry, Transform

dispatch_3 = Dispatch(List=de_workpiecestate.frame_gh, DispatchPattern=null.NullFlags)  # -> ListA, ListB

orient_6 = Orient(Geometry=dispatch.ListA, Source=PlaneXY(0, 0, 0), Target=dispatch_3.ListA)  # -> Geometry, Transform
orient_7 = Orient(Geometry=dispatch.ListB, Source=PlaneXY(0, 0, 0), Target=dispatch_3.ListB)  # -> Geometry, Transform

attached_workpiece_with_trajectory = Geometry(orient_5.Geometry)
attached_workpiece_notrajectory = Geometry(orient_7.Geometry)
filter_3 = StreamFilter(Gate=has_planned_trajectory_2, Stream0=attached_workpiece_notrajectory, Stream1=attached_workpiece_with_trajectory)

# ----
# Workpiece (Previous)
swatch_2 = ColourSwatch(SwatchColor=RGB(112, 122, 109))
preview_2 = CustomPreview(Geometry=orient_6.Geometry, Material=swatch_2)

# ----
# Workpiece (Attached)
swatch_3 = ColourSwatch(SwatchColor=RGB(152, 186, 141))
preview_3 = CustomPreview(Geometry=filter_3, Material=swatch_3)
