# Grasshopper definition Assembly.gh (Grasshopper 1.0.7)

step_to_visualize = Slider(13, range=0..32)
integer_division = IntegerDivision(A=step_to_visualize, B="4")
mod = Modulus(A=step_to_visualize, B="4")
sub_step = Panel(mod)
step = Panel(integer_division)

pickup_tool_tip_frame_srf = Surface(<surface referenced from the Rhino model>)
tool_frame_on_workpieces_srf = Surface([<surface referenced from the Rhino model> x8])
workpieces_brep = Brep([<brep referenced from the Rhino model> x8])
tool_frame_srf = Surface(<surface referenced from the Rhino model>)
brep_tool_geometry = Brep([<brep referenced from the Rhino model> x4])
number_slider = Slider(4, range=0..8)
tool_frame_on_workpieces_srf_2 = Surface([<surface referenced from the Rhino model> x8])
tool_frame_srf_2 = Surface(<surface referenced from the Rhino model>)
brep = Brep([<brep referenced from the Rhino model> x8])
brep_tool_geometry_2 = Brep([<brep referenced from the Rhino model> x3])
pickup_tool_tip_frame_pln = Plane(pickup_tool_tip_frame_srf)
approach_direction_crv = Curve([<curve referenced from the Rhino model> x8])
retract_direction_crv = Curve([<curve referenced from the Rhino model> x8])
pln = Plane(tool_frame_srf_2)
pln_2 = Plane(tool_frame_on_workpieces_srf)
tool_frame_on_workpieces_pln = Plane(tool_frame_on_workpieces_srf_2)
tool_frame_pln = Plane(tool_frame_srf)
group = Group(Objects=brep_tool_geometry)
group_2 = Group(Objects=brep_tool_geometry_2)
orient = Orient(Geometry=group_2, Source=pln, Target=pln_2)  # -> Geometry, Transform
end = EndPoints(Curve=approach_direction_crv)  # -> Start, End
end_2 = EndPoints(Curve=retract_direction_crv)  # -> Start, End
tool_frame_on_workpieces_pln_2 = Plane(tool_frame_on_workpieces_pln)
clash = Clash(FirstSet=workpieces_brep, SecondSet=workpieces_brep, Distance="0.001", L=100)  # -> ClashCount, ClashPoints, ClashRadii, FirstIndex, SecondIndex
orient_2 = Orient(Geometry=group, Source=tool_frame_pln, Target=tool_frame_on_workpieces_pln)  # -> Geometry, Transform
vec2pt = Vector2Pt(PointA=end.Start, PointB=end.End, Unitize=False)  # -> Vector, Length
vec2pt_2 = Vector2Pt(PointA=end_2.Start, PointB=end_2.End, Unitize=False)  # -> Vector, Length
item = ListItem(List=brep, Index=number_slider, Wrap=False)
split = SplitList(List=brep, Index=number_slider)  # -> ListA, ListB
panel = Panel(clash.FirstIndex)
panel_2 = Panel(clash.SecondIndex)
item_2 = ListItem(List=orient.Geometry, Index=number_slider, Wrap=False)
workpieces_brep_2 = Brep(workpieces_brep)
approach_direction_vec = Vector(vec2pt.Vector)
retract_direction_vec = Vector(vec2pt_2.Vector)

split_2 = SplitList(List=workpieces_brep, Index=step)  # -> ListA, ListB
item_3 = ListItem(List=workpieces_brep, Index=step, Wrap=False)
previous_workpiece = Brep(split_2.ListA)
current_workpiece = Brep(item_3)
preview = CustomPreview(Geometry=previous_workpiece, Material=ColourSwatch(SwatchColor=RGB(112, 122, 109)))

item_4 = ListItem(List=orient_2.Geometry, Index=step, Wrap=False)
orient_3 = Orient(Geometry=workpieces_brep, Source=tool_frame_on_workpieces_pln_2, Target=PlaneXY(0, 0, 0))  # -> Geometry, Transform
current_workpiece_2 = Brep(item)
previous_workpiece_2 = Brep(split.ListA)
equals = Equality(FirstNumber=panel, SecondNumber=panel_2)  # -> Equality, Inequality
gripper = Data(item_4)
larger = LargerThan(FirstNumber=panel, SecondNumber=panel_2)  # -> LargerThan, OrEqualTo
clash_2 = Clash(FirstSet=workpieces_brep_2, SecondSet=workpieces_brep_2, Distance="0.001", L=100)  # -> ClashCount, ClashPoints, ClashRadii, FirstIndex, SecondIndex
gripper_2 = Data(item_2)
orient_4 = Orient(Geometry=orient_3.Geometry, Source=PlaneXY(0, 0, 0), Target=pickup_tool_tip_frame_pln)  # -> Geometry, Transform
orient_5 = Orient(Geometry=group, Source=tool_frame_pln, Target=pickup_tool_tip_frame_pln)  # -> Geometry, Transform
and = GateAnd(A=equals.Inequality, B=larger.LargerThan)
item_5 = ListItem(List=retract_direction_vec, Index=step, Wrap=False)
item_6 = ListItem(List=approach_direction_vec, Index=step, Wrap=False)
preview_2 = CustomPreview(Geometry=current_workpiece_2, Material=ColourSwatch(SwatchColor=RGB(152, 186, 141)))
preview_3 = CustomPreview(Geometry=previous_workpiece_2, Material=ColourSwatch(SwatchColor=RGB(112, 122, 109)))
cull = CullPattern(List=panel, CullPattern=and)
cull_2 = CullPattern(List=panel_2, CullPattern=and)
preview_4 = CustomPreview(Geometry=gripper_2, Material=ColourSwatch(SwatchColor=RGB(102, 124, 196)))
item_7 = ListItem(List=orient_4.Geometry, Index=step, Wrap=False)
workpieces_brep_3 = Brep(workpieces_brep)
rev = Reverse(Vector=item_6)
path = ConstructPath(Indices=graft(cull))  # -> flatten(Branch)
int = Integer(simplify(graft(cull_2)))

lng = ListLength(List=workpieces_brep_3)
mesh = MeshBrep(
    Brep=workpieces_brep_3,
    Settings={GridMaxCount=0, GridMinCount=16, JaggedSeams=False, MaxEdgeLength=0, MinEdgeLength=0.0001, MinTolerance=0, Refine=True, RefineAngle=0, RelativeTolerance=0.65, SimplePlanes=False, Tolerance=0})
series = Series(Start=0, Step=1, Count=lng)
int_2 = Integer(series)
mesh_2 = Mesh(mesh)
concat = Concatenate(FragmentA="b", FragmentB=int_2)

viewer = ParamViewer(int)
# Before Approach
move = Move(Geometry=current_workpiece, Motion=rev)  # -> Geometry, Transform
move_2 = Move(Geometry=gripper, Motion=rev)  # -> Geometry, Transform
# After Retract
current_part = Brep(item_3)
# Assembled
current_part_2 = Brep(item_3)
move_3 = Move(Geometry=gripper, Motion=item_5)  # -> Geometry, Transform
# Pick up
current_part_3 = Brep(item_7)
gripper_3 = Data(gripper)
gripper_4 = Data(orient_5.Geometry)
# Flow Chart: FreeMotion: 	FixedPickupTarget
# GripperClose: 	BeamID, Grasp
# FreeMotion: 	BeforeApproachTarget
# LinearMotion: 	FinalTarget
# GripperOpen: 	BeamID
# LinearMotion: 	RetractTarget
tool_frame_on_workpieces_pln_3 = Plane(tool_frame_on_workpieces_pln)
replace = ReplacePaths(Data=int, Search=viewer, Replace=path)
xy = XYPlane(Origin=Point(0, 0, 0))
beam_ids = Text(concat)
beam_ids_2 = Text(beam_ids)
python = GhPythonScript(beam_ids=beam_ids_2, x=clash_2.FirstIndex, y=clash_2.SecondIndex)  # -> out, a; inputs beam_ids: list, x: list, y: list
# ---------- python: Python ----------
a = []
a.append(('b0','b1'))
a.append(('b1','b2'))
import ghpythonlib.treehelpers as th
import Grasshopper as gh
 
tree = gh.DataTree[object]()

for i, beam_id in enumerate(beam_ids):
    tree.Add(None, gh.Kernel.Data.GH_Path(i, ))
    print('Beam %s : '% beam_id)
    for a , b in zip (x,y):
        if i==a and a > b:
            allowed_collision_pair = (beam_ids[a], beam_ids[b])
            print ('  (%s - %s)'%(allowed_collision_pair))
            tree.Add(allowed_collision_pair, gh.Kernel.Data.GH_Path(i, ))

a = tree
# ---------- end python ----------
panel_3 = Panel(python.a)
merge = Merge(Data1=current_part_3, Data2=move.Geometry, Data3=current_part_2, Data4=current_part)
merge_2 = Merge(Data1=gripper_4, Data2=move_2.Geometry, Data3=gripper_3, Data4=move_3.Geometry)
pickup_tool_tip_frame_pln_2 = Plane(pickup_tool_tip_frame_pln)
panel_4 = Panel(replace)
brep_tool_geometry_3 = Brep(brep_tool_geometry)
tool_frame_pln_2 = Plane(tool_frame_pln)
orient_6 = Orient(Geometry=xy, Source=tool_frame_pln_2, Target=tool_frame_on_workpieces_pln_3)  # -> Geometry, Transform
xy_2 = XYPlane(Origin=Point(0, 0, 0))
approach_direction_vec_2 = Vector(approach_direction_vec)
robot_frame_at_assembled = Plane(orient_6.Geometry)
item_8 = ListItem(List=merge, Index=sub_step, Wrap=True)
retract_direction_vec_2 = Vector(retract_direction_vec)
item_9 = ListItem(List=merge_2, Index=sub_step, Wrap=True)
tool = GhPythonScript(tool_id="g1", tool_meshes=brep_tool_geometry_3, frame_in_tool0_frame=tool_frame_pln_2)  # -> out, tool; inputs tool_meshes: list of Mesh
# ---------- tool: Python ----------
from compas_fab.robots import Tool
from compas.robots import ToolModel, RobotModel, Link
from compas_rhino.geometry import RhinoPlane
from compas_rhino.geometry import RhinoMesh

# Convert Rhino Geometry to compas geometry
frame_in_tool0_frame = RhinoPlane.from_geometry(frame_in_tool0_frame).to_compas_frame()

mesh_gripper_base = []
for mesh in tool_meshes:   
    mesh_gripper_base.append(RhinoMesh.from_geometry(mesh).to_compas())

# Use default ToolModel constructor
tool_model = ToolModel(None, frame_in_tool0_frame, name = tool_id)

# Remove default link
hardcoded_link = tool_model.get_link_by_name('attached_tool_link')
if hardcoded_link is not None:
    tool_model.links.remove(hardcoded_link)

# Add a custom link
gripper_base = tool_model.add_link('gripper_base', mesh_gripper_base)
tool = Tool.from_tool_model(tool_model)
# ---------- end tool ----------
orient_7 = Orient(Geometry=xy_2, Source=tool_frame_pln_2, Target=pickup_tool_tip_frame_pln_2)  # -> Geometry, Transform
rev_2 = Reverse(Vector=approach_direction_vec_2)
beam_ids_3 = Text(beam_ids)
workpiece = GhPythonScript(mesh=mesh_2, id=beam_ids)  # -> out, workpiece; inputs mesh: Mesh
# ---------- workpiece: Python ----------
from compas_fab.planning import Workpiece
from compas_rhino.geometry import RhinoMesh

workpiece = Workpiece()

#Mesh
compas_mesh = RhinoMesh.from_geometry(mesh).to_compas()
workpiece.mesh = compas_mesh

workpiece.name = id
# ---------- end workpiece ----------
pickup_tool_base_frame_pln = Plane(orient_7.Geometry)
beam_ids_4 = Text(beam_ids)
lng_2 = ListLength(List=beam_ids_4)
move_4 = Move(Geometry=robot_frame_at_assembled, Motion=rev_2)  # -> Geometry, Transform
lng_3 = ListLength(List=beam_ids_3)
list = ValueList({"LinearMovement", "FreeMovement"}, selected="LinearMovement")
list_2 = ValueList({"LinearMovement", "FreeMovement"}, selected="FreeMovement")
move_5 = Move(Geometry=robot_frame_at_assembled, Motion=retract_direction_vec_2)  # -> Geometry, Transform
list_3 = ValueList({"LinearMovement", "FreeMovement"}, selected="LinearMovement")
list_4 = ValueList({"LinearMovement", "FreeMovement"}, selected="FreeMovement")
preview_5 = CustomPreview(Geometry=item_8, Material=ColourSwatch(SwatchColor=RGB(152, 186, 141)))
preview_6 = CustomPreview(Geometry=item_9, Material=ColourSwatch(SwatchColor=RGB(102, 124, 196)))
repeat = RepeatData(Data=pickup_tool_base_frame_pln, Length=lng_2)
python_2 = GhPythonScript(reload=Button(), module_names="compas_fab")  # -> out; inputs module_names: list
# ---------- python_2: Python ----------
#from compas_ghpython import unload_modules
#
#if reload:
#    for module_name in module_names:
#        unload_modules(module_name)

from compas_ghpython import unload_modules

unload_modules('compas_fab')
# ---------- end python_2 ----------
repeat_2 = RepeatData(Data="g1", Length=lng_3)
movement = Movement(robot_target=repeat, movement_type=list_4)  # -> out, action
movement_2 = Movement(robot_target=move_4.Geometry, allowed_collision_pairs=python.a, movement_type=list_2)  # -> out, action
movement_3 = Movement(robot_target=robot_frame_at_assembled, allowed_collision_pairs=python.a, movement_type=list_3)  # -> out, action
movement_4 = Movement(robot_target=move_5.Geometry, allowed_collision_pairs=python.a, movement_type=list)  # -> out, action
load_workpiece = GhPythonScript(workpiece_id=beam_ids_4, workpiece_frame=pickup_tool_tip_frame_pln_2)  # -> out, action
# ---------- load_workpiece: Python ----------
from compas_fab.planning import LoadWorkpiece
from compas_rhino.geometry import RhinoPlane

action = LoadWorkpiece()
action.workpiece_id = workpiece_id
action.frame = RhinoPlane.from_geometry(workpiece_frame).to_compas_frame()
# ---------- end load_workpiece ----------
close_gripper = GhPythonScript(tool_id="g1", workpiece_id=beam_ids_4)  # -> out, action
# ---------- close_gripper: Python ----------
from compas_fab.planning import CloseGripper
from compas_rhino.geometry import RhinoPlane

action = CloseGripper()
action.tool_id = tool_id
if workpiece_id is not None:
    action.attached_workpiece_id = workpiece_id
    if workpiece_grasp is not None:
        action.attached_workpiece_grasp = workpiece_grasp
# ---------- end close_gripper ----------
panel_5 = Panel(python_2)
open_gripper = GhPythonScript(tool_id=repeat_2)  # -> out, action
# ---------- open_gripper: Python ----------
from compas_fab.planning import OpenGripper
from compas_rhino.geometry import RhinoPlane

action = OpenGripper()
action.tool_id = tool_id
# ---------- end open_gripper ----------
merge_3 = Merge(
    Data1=graft(movement.action),
    Data2=graft(load_workpiece.action),
    Data3=graft(close_gripper.action),
    Data4=graft(movement_2.action),
    Data5=graft(movement_3.action),
    Data6=graft(open_gripper.action),
    Data7=graft(movement_4.action))  # -> flatten(Result)
assemblyprocess = GhPythonScript(workpieces=workpiece.workpiece, tool=tool.tool, assembly_sequence=beam_ids, actions=merge_3)  # -> out, process; inputs workpieces: list, assembly_sequence: list, actions: list
# ---------- assemblyprocess: Python ----------
from compas_fab.planning import AssemblyProcess

process = AssemblyProcess()
for workpiece in workpieces:
    process.workpieces[workpiece.name] = workpiece
process.tool = tool
process.assembly_sequence = assembly_sequence
process.actions = actions

print (process.actions[2].data)
# ---------- end assemblyprocess ----------
auto_path = GhPythonScript(filename="process")  # -> json_path
# ---------- auto_path: Python ----------
from Rhino.RhinoDoc import ActiveDoc
import os
json_path = os.path.split(ActiveDoc.Path)[0] + os.path.sep + filename +".json"
pickle_path = os.path.split(ActiveDoc.Path)[0] + os.path.sep + filename +".pickle"
# ---------- end auto_path ----------
save = Button()
save_compas_json = GhPythonScript(object=assemblyprocess.process, json_path=auto_path, output=save)  # -> out, json_path
# ---------- save_compas_json: Python ----------
if output:
    from compas.utilities import DataDecoder, DataEncoder
    import json
    with open(json_path, 'w') as f:
        json.dump(object, f, cls=DataEncoder, indent=4, sort_keys=True)
# ---------- end save_compas_json ----------
load_compas_json = GhPythonScript(json_path=save_compas_json.json_path)  # -> out, object
# ---------- load_compas_json: Python ----------
from compas.utilities import DataDecoder, DataEncoder
import json
with open(json_path, 'r') as f:
    object = json.load(f, cls=DataDecoder)
# ---------- end load_compas_json ----------

# ----
# Save
# Save location next to Rhino File
# Fle name = tool_name.json
auto_path_2 = GhPythonScript(tool_name="g1")  # -> json_path
# ---------- auto_path_2: Python ----------
from Rhino.RhinoDoc import ActiveDoc
import os
json_path = os.path.split(ActiveDoc.Path)[0] + os.path.sep + tool_name +".json"
pickle_path = os.path.split(ActiveDoc.Path)[0] + os.path.sep + tool_name +".pickle"
# ---------- end auto_path_2 ----------
save_2 = Button()
save_compas_json_2 = GhPythonScript(tool_model=tool.tool, json_path=auto_path_2, output=save_2)  # -> out, json_path
# ---------- save_compas_json_2: Python ----------
if output:
    from compas.utilities import DataDecoder, DataEncoder
    import json
    with open(json_path, 'w') as f:
        json.dump(tool_model, f, cls=DataEncoder, indent=4, sort_keys=True)
# ---------- end save_compas_json_2 ----------

# ----
# Load Test
load_compas_json_2 = GhPythonScript(json_path=save_compas_json_2.json_path)  # -> out, object; same code as load_compas_json
decompose_tool = GhPythonScript(tool=load_compas_json_2.object)  # -> out, tool_model
# ---------- decompose_tool: Python ----------
tool_model = tool.tool_model
# ---------- end decompose_tool ----------

# ----
# Test set current_frame_from_tcf
frame_curves_named_x_and_y = Curve([<curve referenced from the Rhino model> x3])
frame_from_crv = FrameFromCrv(frame_curves_named_x_and_y=frame_curves_named_x_and_y)
deepcopy = GhPythonScript(data_in=load_compas_json_2.object)  # -> data_out
# ---------- deepcopy: Python ----------
from copy import deepcopy
data_out = deepcopy(data_in)
# ---------- end deepcopy ----------
set_clamp_state = GhPythonScript(robot_model=deepcopy, tcf=frame_from_crv)  # -> out, robot_model_out, current_frame; inputs tcf: Plane
# ---------- set_clamp_state: Python ----------
from compas_rhino.geometry import RhinoPlane
from compas_ghpython import draw_frame
# Deep copy should be performed before editing
robot_model_out = robot_model.copy()
robot_model_out.set_current_frame_from_tcp(RhinoPlane.from_geometry(tcf).to_compas())
current_frame = draw_frame(robot_model_out.current_frame)
# ---------- end set_clamp_state ----------
robot_artist = GhPythonScript(tool_model=set_clamp_state.robot_model_out)  # -> out, visual; inputs current_frame: Plane
# ---------- robot_artist: Python ----------
from compas_ghpython.artists import RobotModelArtist
from compas_rhino.geometry import RhinoPlane
from compas.geometry import Transformation

# Create a transformation for base location
if current_frame:
    current_cframe = RhinoPlane.from_geometry(current_frame).to_compas()
    tool_model.current_frame = current_cframe

#compas_visual_mesh = tool_model.draw_visual()
#print (compas_visual_mesh)

artist = RobotModelArtist(tool_model)
visual = tool_model.draw_visual(artist)
# ---------- end robot_artist ----------

# ----
# Test Motion
# Test Full Stroke Movement
_0_0_to_1_0_relative_position = Slider(0, range=0..1)
_0_0_to_1_0_relative_position_2 = Slider(0, range=0..1)
deepcopy_2 = GhPythonScript(data_in=decompose_tool.tool_model)  # -> data_out
# ---------- deepcopy_2: Python ----------
data_out = data_in.copy()
# ---------- end deepcopy_2 ----------
set_clamp_state_2 = GhPythonScript(
    robot_model=deepcopy_2,
    gripper_jaw_position_relative=_0_0_to_1_0_relative_position_2,
    clamp_jaw_position_relative=_0_0_to_1_0_relative_position)  # -> out, robot_model_out
# ---------- set_clamp_state_2: Python ----------
from integral_timber_joints.ghpython.utilities import rPlane2cFrame
from compas_rhino.geometry import RhinoPlane

# Deep copy should be performed before editing
robot_model_out = robot_model.copy()

# Set State
if hasattr(robot_model_out,"gripper_jaw_limits"):
    limits = robot_model_out.gripper_jaw_limits
    robot_model_out.gripper_jaw_position = gripper_jaw_position_relative * (limits[1]-limits[0]) + limits[0]

if hasattr(robot_model_out,"clamp_jaw_limits"):
    limits = robot_model_out.clamp_jaw_limits
    print (limits)
    robot_model_out.clamp_jaw_position = clamp_jaw_position_relative * (limits[1]-limits[0]) + limits[0]
# ---------- end set_clamp_state_2 ----------

tc3_tool_changer = Data()
deepcopy_3 = GhPythonScript(data_in=tc3_tool_changer)  # -> data_out; same code as deepcopy
set_clamp_state_3 = GhPythonScript(robot_model=deepcopy_3, tcf=set_clamp_state.current_frame)  # -> out, robot_model_out, current_frame; inputs tcf: Plane; same code as set_clamp_state
robot_artist_2 = GhPythonScript(tool_model=set_clamp_state_3.robot_model_out)  # -> out, visual; inputs current_frame: Plane; same code as robot_artist

# ----
# Visualisation
show_end_effector_frame = BooleanToggle(False)
show_base_frame = BooleanToggle(False)
show_collision = BooleanToggle(False)
show_frames = BooleanToggle(False)
show_visual = BooleanToggle(True)
visualize = PythonScript(
    tool_model=decompose_tool.tool_model,
    show_visual=show_visual,
    show_collision=show_collision,
    show_frames=show_frames,
    show_base_frame=show_base_frame,
    show_end_effector_frame=show_end_effector_frame)  # -> visual, collision, frames, ee_frame, base_frame
# ---------- visualize: Python ----------
from __future__ import print_function
from compas_ghpython.artists import RobotModelArtist
artist = RobotModelArtist(tool_model)
visual = artist.draw_visual()
collision = artist.draw_collision()
# ---------- end visualize ----------
draw = GhPythonScript(frames=[visualize.frames, visualize.ee_frame, visualize.base_frame], scale=Slider(0.1, range=0..1))  # -> P, V, C, W; inputs frames: list
# ---------- draw: Python ----------
from System.Drawing import Color
from compas_ghpython.utilities import draw_frame

red = Color.FromArgb(255, 0, 0)
green = Color.FromArgb(0, 255, 0)
blue = Color.FromArgb(0, 0, 255)

P = []
V = []
C = []

scale = float(scale)

for frame in frames:
    if not frame:
        continue
    plane = draw_frame(frame)
    P += [plane.Origin] * 3
    V.append(plane.XAxis * scale)
    V.append(plane.YAxis * scale)
    V.append(plane.ZAxis * scale)
    C += [red, green, blue]

W = 3
# ---------- end draw ----------
geo = Geometry(visualize.collision)
geo_2 = Geometry(visualize.visual)
vdisex = VectorDisplayEx(Point=draw.P, Vector=draw.V, Colour=draw.C, Width=draw.W)

# ==== cluster FrameFromCrv
frame_curves_named_x_and_y = ClusterInput()
frame_curves_named_x_and_y_2 = Curve(frame_curves_named_x_and_y)
filtername = FilterByName(Geometry=frame_curves_named_x_and_y_2, Name="y")
filtername_2 = FilterByName(Geometry=frame_curves_named_x_and_y_2, Name="x")
end = EndPoints(Curve=filtername_2)  # -> Start, End
end_2 = EndPoints(Curve=filtername)  # -> Start, End
pl_3pt = Plane3Pt(PointA=end.Start, PointB=end.End, PointC=end_2.End)
pl = ClusterOutput(pl_3pt)

# ==== cluster Movement
robot_target = ClusterInput()
allowed_collision_pairs = ClusterInput()
fixed_configuration = ClusterInput()
movement_type = ClusterInput()
movement = GhPythonScript(
    robot_target=graft(robot_target),
    allowed_collision_pairs=allowed_collision_pairs,
    fixed_configuration=fixed_configuration,
    movement_type=movement_type)  # -> out, flatten(action); inputs robot_target: Plane, allowed_collision_pairs: list
# ---------- movement: Python ----------
from compas_fab.planning import FreeMovement, LinearMovement
from compas_rhino.geometry import RhinoPlane

if movement_type == 'FreeMovement':
    action = FreeMovement()
elif movement_type == 'LinearMovement':
    action = LinearMovement()
else:
    raise ValueError('movement type not supported')

action.robot_target = RhinoPlane.from_geometry(robot_target).to_compas_frame()

if allowed_collision_pairs is not None:
    action.allowed_collision_pairs = []
    for pair in allowed_collision_pairs:
        if pair is not None:
            action.allowed_collision_pairs.append(pair)

if fixed_configuration is not None:
    action.fixed_configuration = fixed_configuration
# ---------- end movement ----------
out = ClusterOutput(movement.out)
action = ClusterOutput(movement.action)
