# Grasshopper definition 00_rfl_urdf_visualization.gh (Grasshopper 1.0.7)

# ----
# Auto-locate repo submodule
rhino_doc_dir = RhinoDocDir()  # -> rhino_doc_dir
# ---------- rhino_doc_dir: Python ----------
import scriptcontext as sc
from os import path

rhino_doc_dir = path.abspath(path.dirname(sc.doc.Path))
# ---------- end rhino_doc_dir ----------
ghpython_script = GhPythonScript(current_path=rhino_doc_dir)  # -> out, path
# ---------- ghpython_script: Python ----------
import os

path = os.path.abspath(os.path.join(current_path, '..','..'))
# ---------- end ghpython_script ----------

# ----
# Development Tools
# Reload Python Modules (if Module Code is Changed)
python_module_to_reload = Panel("""compas
compas_fab
roslibpy
integral_timber_joints""")
reload = Button()
py = PythonScript(reload_module_button=reload, module_names=python_module_to_reload)  # inputs module_names: list
# ---------- py: Python ----------
import compas_ghpython
from compas_ghpython import unload_modules
if reload_module_button:
    for module in module_names:
        unload_modules(module)
# ---------- end py ----------

# ----
# Check Path and Environment
compas_version = GhPythonScript()  # -> out, compas_version, compas_fab_version, compas_path, compas_fab_path, compas_env_name, python_directory
# ---------- compas_version: Python ----------
__author__ = "leungp"
__version__ = "2020.04.20"

import rhinoscriptsyntax as rs
import compas
import compas_fab
compas_version  = compas.__version__
compas_fab_version = compas_fab.__version__
import os
compas_path = os.path.abspath(compas.__file__)
compas_fab_path = os.path.abspath(compas_fab.__file__)

import compas_bootstrapper
compas_env_name = compas_bootstrapper.ENVIRONMENT_NAME
python_directory = compas_bootstrapper.PYTHON_DIRECTORY
# ---------- end compas_version ----------
compas_environment_name = Panel(compas_version.compas_env_name)
compas_version_2 = Panel(compas_version.compas_version)
compas_fab_version = Panel(compas_version.compas_fab_version)
compas_path = Panel(compas_version.compas_path)
compas_fab_path = Panel(compas_version.compas_fab_path)
python_directory = Panel(compas_version.python_directory)

path_containing_the_rfl_description_pack = Panel(ghpython_script.path)  # "Path containing the rfl_description package"
rfl_description_package_name = Panel("rfl_description")
urdf_file_name = Panel("rfl_pybullet.urdf")
srdf_file_name = Panel("rfl.srdf")

robot11_joint_ea_z = Slider(-3.4, range=-5..0)

# ----
# Load Robot
load = Button()
ghpython_script_2 = PythonScript(
    load=load,
    pkg_path=path_containing_the_rfl_description_pack,
    pkg_name=rfl_description_package_name,
    urdf_file=urdf_file_name,
    srdf_file=srdf_file_name)  # -> out, robot
# ---------- ghpython_script_2: Python ----------
from scriptcontext import sticky as st
import os
import compas

from compas.robots import RobotModel
from compas.robots import GithubPackageMeshLoader
from compas.robots import LocalPackageMeshLoader
from compas_fab.robots import Robot
from compas_fab.robots import RobotSemantics
from compas_ghpython.artists import RobotModelArtist

# Robot meshes are usually in meters
# Set a high percision to prevent parsing errors
# and configure Rhino itself in meters
compas.PRECISION = '12f'

# Store robot in component-based key
robot_key = 'robot_{}'.format(str(ghenv.Component.InstanceGuid))

if robot_key not in st:
    st[robot_key] = None

if load:
    # Also load geometry
    loader = LocalPackageMeshLoader(os.path.join(pkg_path, 'rfl_description'), pkg_name)
    abb_loader = LocalPackageMeshLoader(os.path.join(pkg_path), "abb_irb4600_40_255")
    
    # Create robot model from URDF
    model = RobotModel.from_urdf_string(loader.load_urdf(urdf_file).read())
    model.load_geometry(loader, abb_loader)

    artist = RobotModelArtist(model)
    
    robot_semantics = None
    if srdf_file:
        robot_semantics = RobotSemantics.from_srdf_file(loader.build_path('urdf', srdf_file), model)
    
    robot = Robot(model, artist, semantics=robot_semantics)
#    robot.scale(1000)
    st[robot_key] = robot

robot = st[robot_key]

#repo    = 'ros-industrial/abb'
#package = 'abb_irb6600_support'
#branch  = 'kinetic-devel'
#
#github = GithubPackageMeshLoader(repo, package, branch)
#
#model = RobotModel.from_urdf_file(github.load_urdf('irb6640.urdf'))
#model.load_geometry(github)
#artist = RobotModelArtist(model)
#robot = Robot(model, artist)
# ---------- end ghpython_script_2 ----------
robot = Data(ghpython_script_2.robot)

configuration_change = GhPythonScript(robot=robot, bridge1_joint_EA_X=Slider(0, range=0..10), robot11_joint_EA_Z=robot11_joint_ea_z)  # -> out, configuration
# ---------- configuration_change: Python ----------
configuration = robot.zero_configuration()
configuration['bridge1_joint_EA_X'] = bridge1_joint_EA_X
configuration['robot11_joint_EA_Z'] = robot11_joint_EA_Z
print (configuration)
# ---------- end configuration_change ----------
rad = Radians(Degrees=Slider(0, range=0..360))
rad_2 = Radians(Degrees=Slider(0, range=0..360))
rad_3 = Radians(Degrees=Slider(0, range=0..360))
panel = Panel(ghpython_script_2.out)
python = GhPythonScript(robot=robot, u=rad, v=rad_2, w=rad_3)  # -> out, robot_out; disabled
# ---------- python: Python ----------
from compas.robots import Origin
from compas.geometry import Transformation
attributes = {'rpy': '%s %s %s' % (u,v,w), 'xyz': '0.0 0.0 0.0'}
joint = robot.get_joint_by_name('robot11_joint_EA_Z')
joint.origin = Origin.from_urdf(attributes, [], None)

robot.model._create(robot.model.root, Transformation())
#joint.current_origin = joint.origin.copy()

robot_out = robot
# ---------- end python ----------
# Global XYZ offset to align Robot origin and iGPS origin:
# world_joint
# 
# Robot 11 Gantry Z column tilt:
# - joint: robot11_joint_EA_Z (rpy 2nd 3rd value)
# 
# Adjusting the origin of robot11_base (The Gantry Z Link):
# - joint: robot11_joint_EA_Z (origin Z = 5)
# - joint: robot11_joint_0 (origin Z = -5)
# - link: robot11_base (visual and collision geometry origin Z -5)
panel_2 = Panel(configuration_change.out)
python_2 = GhPythonScript(robot=robot)  # -> out, a
# ---------- python_2: Python ----------
print robot.zero_configuration
# ---------- end python_2 ----------

# ----
# Robot Visualisation
show_end_effector_frame = BooleanToggle(True)
show_base_frame = BooleanToggle(False)
show_collision = BooleanToggle(True)
show_frames = BooleanToggle(True)
show_visual = BooleanToggle(True)
visualize = PythonScript(
    robot=robot,
    group="robot11_eaXYZ",
    configuration=configuration_change.configuration,
    show_visual=show_visual,
    show_collision=show_collision,
    show_frames=show_frames,
    show_base_frame=show_base_frame,
    show_end_effector_frame=show_end_effector_frame)  # -> out, link_names, joint_names, visual, collision, frames, ee_frame, base_frame
# ---------- visualize: Python ----------
"""Visualizes a robot.
    Inputs:
        robot: The robot
        configuration: :class:`compas_fab.robots.Configuration`
            The robot's full configuration to display.
        show_visual: bool
           Whether or not to show the robot's visual meshes.
        show_collision: bool
           Whether or not to show the robot's collision meshes.
        show_frames: bool
           Whether or not to show the robot's joint frames.
        show_base_frame: bool
           Whether or not to show the robot's base frame.
        show_end_effector_frame: bool
            Whether or not to show the robot's end-effector frame.
    Output:
        visual: The robot's visual meshes.
        collision: The robot's collision meshes.
        frames: The robot's joint frames.
        base_frame: The robot's base frame.
        ee_frame: The robot's end-effector frame.
"""
from __future__ import print_function
from compas.geometry import Frame
print (robot.group_names)

if not configuration:
    configuration = robot.zero_configuration()
    
if robot and configuration:
    group = group or robot.main_group_name
    robot.update(configuration, group, visual=show_visual, collision=show_collision)
    print(robot.get_end_effector_link_name(group))
    if show_visual:
        visual = robot.artist.draw_visual()

    if show_collision:
        collision = robot.artist.draw_collision()

    if show_frames:
        axes = robot.transformed_axes(configuration, group)
        frames = robot.transformed_frames(configuration, group)

    if show_base_frame:
        frames = robot.transformed_frames(configuration, group)
        base_frame = frames[0]

    if show_end_effector_frame:
        ee_frame = robot.forward_kinematics(configuration, group)
        ee_frame = Frame.from_data(ee_frame.data)
        
        print ("End-effector", ee_frame)
link_names = []
for link in robot.model.iter_links():
    for item in getattr(link, 'visual'):
        link_names.append (link.name)
        
joint_names = [joint.name for joint in robot.model.iter_joints()]
print (frames)
# ---------- end visualize ----------
number_slider = Slider(1, range=0..1)
python_3 = GhPythonScript(frame=visualize.ee_frame)  # -> out, plane
# ---------- python_3: Python ----------
from compas_ghpython import draw_frame
plane = draw_frame(frame)
# ---------- end python_3 ----------
draw = GhPythonScript(frames=visualize.ee_frame, scale=number_slider)  # -> P, V, C, W, flatten(planes); inputs frames: list
# ---------- draw: Python ----------
from System.Drawing import Color
from compas_ghpython import draw_frame

red = Color.FromArgb(255, 0, 0)
green = Color.FromArgb(0, 255, 0)
blue = Color.FromArgb(0, 0, 255)

P = []
V = []
C = []
planes = []

scale = float(scale)

for frame in frames:
    if not frame:
        continue
    plane = draw_frame(frame)
    P += [plane.Origin] * 3
    V.append(plane.XAxis * scale)
    V.append(plane.YAxis * scale)
    V.append(plane.ZAxis * scale)
    C += [red, green, blue]
    planes.append(plane)

W = 3
# ---------- end draw ----------
scale = Scale(Geometry=draw.P, Center=Point(0, 0, 0), Factor=1000)  # -> Geometry, Transform
scale_2 = Scale(Geometry=python_3.plane, Center=Point(0, 0, 0), Factor=1000)  # -> Geometry, Transform
vector_display_ex = VectorDisplayEx(Point=draw.P, Vector=draw.V, Colour=draw.C, Width=draw.W)
panel_3 = Panel(scale_2.Geometry)

panel_4 = Panel("robot12_eaYZ")
draw_2 = GhPythonScript(frames=visualize.base_frame, scale=number_slider)  # -> P, V, C, W, flatten(planes); inputs frames: list; same code as draw
panel_5 = Panel(visualize.joint_names)
number_slider_2 = Slider(5, range=0..100)
item = ListItem(List=visualize.joint_names, Index=number_slider_2, Wrap=True)
item_2 = ListItem(List=visualize.frames, Index=number_slider_2, Wrap=True)
panel_6 = Panel(item)
draw_3 = GhPythonScript(frames=item_2, scale=number_slider)  # -> P, V, C, W, flatten(planes); inputs frames: list; same code as draw
draw_4 = GhPythonScript(frames=visualize.frames, scale=number_slider)  # -> P, V, C, W, flatten(planes); inputs frames: list; same code as draw
geo = Geometry(draw.planes)
