# Grasshopper definition 02_rfl_urdf_adjustment_world_joint.gh (Grasshopper 1.0.7)

# ----
# Auto-locate repo submodule
rhino_doc_dir = RhinoDocDir()  # -> rhino_doc_dir
# ---------- rhino_doc_dir: Python ----------
import scriptcontext as sc
from os import path

rhino_doc_dir = path.abspath(path.dirname(sc.doc.Path))
# ---------- end rhino_doc_dir ----------
ghpython_script = GhPythonScript(current_path=rhino_doc_dir)  # -> out, path
# ---------- ghpython_script: Python ----------
import os

path = os.path.abspath(os.path.join(current_path, '..','..'))
# ---------- end ghpython_script ----------

panel = Panel("C:\Users\leungp\Documents\GitHub\rfl_toolbox\collected_data")  # disabled

# ----
# Development Tools
# Reload Python Modules (if Module Code is Changed)
python_module_to_reload = Panel("""compas
compas_fab
roslibpy
integral_timber_joints""")
reload = Button()
py = PythonScript(reload_module_button=reload, module_names=python_module_to_reload)  # inputs module_names: list
# ---------- py: Python ----------
import compas_ghpython
from compas_ghpython import unload_modules
if reload_module_button:
    for module in module_names:
        unload_modules(module)
# ---------- end py ----------

# ----
# Check Path and Environment
compas_version = GhPythonScript()  # -> out, compas_version, compas_fab_version, compas_path, compas_fab_path, compas_env_name, python_directory
# ---------- compas_version: Python ----------
__author__ = "leungp"
__version__ = "2020.04.20"

import rhinoscriptsyntax as rs
import compas
import compas_fab
compas_version  = compas.__version__
compas_fab_version = compas_fab.__version__
import os
compas_path = os.path.abspath(compas.__file__)
compas_fab_path = os.path.abspath(compas_fab.__file__)

import compas_bootstrapper
compas_env_name = compas_bootstrapper.ENVIRONMENT_NAME
python_directory = compas_bootstrapper.PYTHON_DIRECTORY
# ---------- end compas_version ----------
compas_environment_name = Panel(compas_version.compas_env_name)
compas_version_2 = Panel(compas_version.compas_version)
compas_fab_version = Panel(compas_version.compas_fab_version)
compas_path = Panel(compas_version.compas_path)
compas_fab_path = Panel(compas_version.compas_fab_path)
python_directory = Panel(compas_version.python_directory)

# ----
# <joint name="robot11_joint_EA_Z" type="prismatic">
#     <parent link="robot11_xy_cart"/>
#     <child link="robot11_base"/>
#     <origin rpy="0 0 0 " xyz="0 0 0"/>
#     <axis xyz="0 0 -1"/>
#     <limit effort="100000" lower="-4.915" upper="-1.005" velocity="2.618"/>
#     <dynamics damping="0.2" friction="0"/>
#   </joint>
# <joint name="robot11_joint_0" type="fixed">
#     <parent link="robot11_base"/>
#     <child link="robot11_base_link"/>
#     <origin rpy="3.14159265359 0 0.0" xyz="0 0 0"/>
#     <dynamics damping="0.2" friction="0"/>
#   </joint>
python = GhPythonScript(path=panel)  # -> out, points_axis_x1_39, points_axis_x1_59, points_axis_y1_39, points_axis_y2_39, points_axis_z1_39, points_axis_z2_39, J1_armdown_39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; disabled
# ---------- python: Python ----------
import compas
import rfl_toolbox
import os
import rhinoscriptsyntax as rs
from Rhino.Geometry import Point3d
# Data sets
datasets = {}
points_axis_xy_rectangle = compas.json_load(os.path.join(path, '20210601_193837_XY.json'))
datasets['points_axis_x1'] = points_axis_xy_rectangle[0]
datasets['points_axis_y1'] = points_axis_xy_rectangle[1]
datasets['points_axis_x2'] = points_axis_xy_rectangle[2]
datasets['points_axis_y2'] = points_axis_xy_rectangle[3]
datasets['points_axis_z1'] = compas.json_load(os.path.join(path, '20210607_152933_Zfront.json'))
datasets['points_axis_z2'] = compas.json_load(os.path.join(path, '20210607_152425_Zback.json'))


quality_threshold = 12
points_axis_x1_39 = [Point3d(*pt['igps_frame_39'].origin) for pt in datasets['points_axis_x1'] if pt['igps_frame_39'].quality >= quality_threshold]
points_axis_x1_59 = [Point3d(*pt['igps_frame_59'].origin) for pt in datasets['points_axis_x1'] if pt['igps_frame_59'].quality >= quality_threshold]

points_axis_y1_39 = [Point3d(*pt['igps_frame_39'].origin) for pt in datasets['points_axis_y1'] if pt['igps_frame_39'].quality >= quality_threshold]
points_axis_y2_39 = [Point3d(*pt['igps_frame_39'].origin) for pt in datasets['points_axis_y2'] if pt['igps_frame_39'].quality >= quality_threshold]

points_axis_z1_39 = [Point3d(*pt['igps_frame_39'].origin) for pt in datasets['points_axis_z1'] if pt['igps_frame_39'].quality >= quality_threshold]
points_axis_z2_39 = [Point3d(*pt['igps_frame_39'].origin) for pt in datasets['points_axis_z2'] if pt['igps_frame_39'].quality >= quality_threshold]


datasets['J1_armdown'] = compas.json_load(os.path.join(path, '20210607_163105_J1_armdown.json'))
datasets['J1_armfront'] = compas.json_load(os.path.join(path, '20210607_163724_J1_armfront.json'))
datasets['J1_armback'] = compas.json_load(os.path.join(path, '20210607_164532_J1_armback.json'))
datasets['J2_Z4800_base'] = compas.json_load(os.path.join(path, '20210607_155103_J2_Base_FullExtend_Z-4800.json'))
datasets['J2_Z4800_tool'] = compas.json_load(os.path.join(path, '20210607_160318_J2_Tool_FullExtend_Z-4800.json'))
datasets['J2_Z3700_base'] = compas.json_load(os.path.join(path, '20210607_154630_J2_Base_FullExtend_Z-3700.json'))
datasets['J2_Z3700_tool'] = compas.json_load(os.path.join(path, '20210607_155914_J2_Tool_FullExtend_Z-3700.json'))

datasets['J3_armdown'] = compas.json_load(os.path.join(path, '20210607_161315_J3_armdown.json'))
datasets['J3_armback'] = compas.json_load(os.path.join(path, '20210607_161922_J3_armback.json'))
datasets['J3_armfront'] = compas.json_load(os.path.join(path, '20210607_162546_J3_armfront.json'))


J1_armdown_39 = [Point3d(*pt['igps_frame_39'].origin) for pt in datasets['J1_armdown'] if pt['igps_frame_39'].quality >= quality_threshold]
J1_armdown_59 = [Point3d(*pt['igps_frame_59'].origin) for pt in datasets['J1_armdown'] if pt['igps_frame_59'].quality >= quality_threshold]
J1_armfront_39 = [Point3d(*pt['igps_frame_39'].origin) for pt in datasets['J1_armfront'] if pt['igps_frame_39'].quality >= quality_threshold]
J1_armfront_59 = [Point3d(*pt['igps_frame_59'].origin) for pt in datasets['J1_armfront'] if pt['igps_frame_59'].quality >= quality_threshold]
J1_armback_39 = [Point3d(*pt['igps_frame_39'].origin) for pt in datasets['J1_armback'] if pt['igps_frame_39'].quality >= quality_threshold]
J1_armback_59 = [Point3d(*pt['igps_frame_59'].origin) for pt in datasets['J1_armback'] if pt['igps_frame_59'].quality >= quality_threshold]

J2_Z4800_base_39 = [Point3d(*pt['igps_frame_39'].origin) for pt in datasets['J2_Z4800_base'] if pt['igps_frame_39'].quality >= quality_threshold]
J2_Z4800_tool_39 = [Point3d(*pt['igps_frame_39'].origin) for pt in datasets['J2_Z4800_tool'] if pt['igps_frame_39'].quality >= quality_threshold]
J2_Z3700_base_39 = [Point3d(*pt['igps_frame_39'].origin) for pt in datasets['J2_Z3700_base'] if pt['igps_frame_39'].quality >= quality_threshold]
J2_Z3700_tool_39 = [Point3d(*pt['igps_frame_39'].origin) for pt in datasets['J2_Z3700_tool'] if pt['igps_frame_39'].quality >= quality_threshold]

J3_armdown_39 = [Point3d(*pt['igps_frame_39'].origin) for pt in datasets['J3_armdown'] if pt['igps_frame_39'].quality >= quality_threshold]
J3_armback_39 = [Point3d(*pt['igps_frame_39'].origin) for pt in datasets['J3_armback'] if pt['igps_frame_39'].quality >= quality_threshold]
J3_armfront_59 = [Point3d(*pt['igps_frame_59'].origin) for pt in datasets['J3_armfront'] if pt['igps_frame_59'].quality >= quality_threshold]
# ---------- end python ----------
path_containing_the_rfl_description_pack = Panel("C:\Users\leungp\Documents\GitHub\integral_timber_joints\external")  # "Path containing the rfl_description package"

path_containing_the_rfl_description_pack_2 = Panel(ghpython_script.path)  # "Path containing the rfl_description package"
rfl_description_package_name = Panel("rfl_description")
urdf_file_name = Panel("rfl_pybullet.urdf")
# <joint name="world_joint" type="fixed">
#     <parent link="world"/>
#     <child link="x_rail"/>
#     <origin rpy="0.0 0.0 0.0" xyz="0.0 0.0 0.0"/>
#   </joint>
srdf_file_name = Panel("rfl.srdf")

number_slider = Slider(2.608024, range=-1..3)
number_slider_2 = Slider(-3.5e-05, range=-0.05..0.05)

# ----
# Load Robot
load = Button()
ghpython_script_2 = PythonScript(
    load=load,
    pkg_path=path_containing_the_rfl_description_pack_2,
    pkg_name=rfl_description_package_name,
    urdf_file=urdf_file_name,
    srdf_file=srdf_file_name)  # -> out, robot
# ---------- ghpython_script_2: Python ----------
from scriptcontext import sticky as st
import os
import compas

from compas.robots import RobotModel
from compas.robots import GithubPackageMeshLoader
from compas.robots import LocalPackageMeshLoader
from compas_fab.robots import Robot
from compas_fab.robots import RobotSemantics
from compas_ghpython.artists import RobotModelArtist

# Robot meshes are usually in meters
# Set a high percision to prevent parsing errors
# and configure Rhino itself in meters
compas.PRECISION = '12f'

# Store robot in component-based key
robot_key = 'robot_{}'.format(str(ghenv.Component.InstanceGuid))

if robot_key not in st:
    st[robot_key] = None

if load:
    # Also load geometry
    loader = LocalPackageMeshLoader(os.path.join(pkg_path, 'rfl_description'), pkg_name)
    abb_loader = LocalPackageMeshLoader(os.path.join(pkg_path), "abb_irb4600_40_255")
    
    # Create robot model from URDF
    model = RobotModel.from_urdf_string(loader.load_urdf(urdf_file).read())
    model.load_geometry(loader, abb_loader)

    artist = RobotModelArtist(model)
    
    robot_semantics = None
    if srdf_file:
        robot_semantics = RobotSemantics.from_srdf_file(loader.build_path('urdf', srdf_file), model)
    
    robot = Robot(model, artist, semantics=robot_semantics)
#    robot.scale(1000)
    st[robot_key] = robot

robot = st[robot_key]

#repo    = 'ros-industrial/abb'
#package = 'abb_irb6600_support'
#branch  = 'kinetic-devel'
#
#github = GithubPackageMeshLoader(repo, package, branch)
#
#model = RobotModel.from_urdf_file(github.load_urdf('irb6640.urdf'))
#model.load_geometry(github)
#artist = RobotModelArtist(model)
#robot = Robot(model, artist)
# ---------- end ghpython_script_2 ----------
robot = Data(ghpython_script_2.robot)

rad = Radians(Degrees=Slider(0, range=0..360))
rad_2 = Radians(Degrees=Slider(-0.085, range=-1..1))
rad_3 = Radians(Degrees=Slider(0, range=0..360))
rad_4 = Radians(Degrees=Slider(0.007, range=0..0.01))
python_2 = GhPythonScript(
    robot=robot,
    joint_name="world_joint",
    x=Slider(2.60875, range=-1..3),
    y=Slider(2.06001, range=-1..3),
    z=Slider(-0.041607, range=-1..1),
    u=number_slider_2,
    v=Slider(-3.5e-05, range=-0.05..0.05),
    w=Slider(1.5e-05, range=-0.05..0.05))  # -> out, robot_out
# ---------- python_2: Python ----------
from compas.robots import Origin
from compas.geometry import Transformation

attributes = {'xyz': '%f %f %f' % (x,y,z), 'rpy': '%f %f %f' % (u,v,w)}
print attributes
joint = robot.get_joint_by_name(joint_name)
joint.origin = Origin.from_urdf(attributes, [], None)

robot.model._create(robot.model.root, Transformation())
robot_out = robot
# ---------- end python_2 ----------
python_3 = GhPythonScript(
    robot=python_2.robot_out,
    joint_name="robot11_joint_EA_Z",
    x=Slider(0.01, range=-1..1),
    y=Slider(0, range=-1..1),
    z=Slider(0, range=-1..1),
    u=rad,
    v=rad_2,
    w=rad_3)  # -> out, robot_out; same code as python_2
panel_2 = Panel("C:\Users\leungp\Documents\GitHub\rfl_toolbox\collected_data")
list = ValueList({"points_axis_x1", "points_axis_x2", "points_axis_y1", "points_axis_y2", "points_axis_z1", "points_axis_z2", "J1_armdown", "J1_armfront", "J1_armback", "J2_Z4800_base", "J2_Z4800_tool", "J2_Z3700_base", "J2_Z3700_tool", "J3_armdown", "J3_armback", "J3_armfront"}, selected="points_axis_x1")
list_2 = ValueList({"points_axis_x1", "points_axis_x2", "points_axis_y1", "points_axis_y2", "points_axis_z1", "points_axis_z2", "J1_armdown", "J1_armfront", "J1_armback", "J2_Z4800_base", "J2_Z4800_tool", "J2_Z3700_base", "J2_Z3700_tool", "J3_armdown", "J3_armback", "J3_armfront"}, selected="points_axis_y1")
list_3 = ValueList({"points_axis_x1", "points_axis_x2", "points_axis_y1", "points_axis_y2", "points_axis_z1", "points_axis_z2", "J1_armdown", "J1_armfront", "J1_armback", "J2_Z4800_base", "J2_Z4800_tool", "J2_Z3700_base", "J2_Z3700_tool", "J3_armdown", "J3_armback", "J3_armfront"}, selected="points_axis_y2")
list_4 = ValueList({"points_axis_x1", "points_axis_x2", "points_axis_y1", "points_axis_y2", "points_axis_z1", "points_axis_z2", "J1_armdown", "J1_armfront", "J1_armback", "J2_Z4800_base", "J2_Z4800_tool", "J2_Z3700_base", "J2_Z3700_tool", "J3_armdown", "J3_armback", "J3_armfront"}, selected="points_axis_x2")
list_5 = ValueList({"igps_frame_39", "igps_frame_59"}, selected="igps_frame_39")  # disabled
galapagos = Galapagos(fitness=ma, gene=number_slider_2)
python_4 = GhPythonScript(path=panel_2, dataset_name=[list, list_4, list_2, list_3])  # -> out, flatten(configurations), flatten(sensor_39_points), flatten(sensor_59_points)
# ---------- python_4: Python ----------
import compas
import rfl_toolbox
import os
import rhinoscriptsyntax as rs
from Rhino.Geometry import Point3d
from compas.robots import Configuration, Joint
from compas_fab.robots import to_radians
# Data sets
datasets = {}
points_axis_xy_rectangle = compas.json_load(os.path.join(path, '20210601_193837_XY.json'))
datasets['points_axis_x1'] = points_axis_xy_rectangle[0]
datasets['points_axis_y1'] = points_axis_xy_rectangle[1]
datasets['points_axis_x2'] = points_axis_xy_rectangle[2]
datasets['points_axis_y2'] = points_axis_xy_rectangle[3]
datasets['points_axis_z1'] = compas.json_load(os.path.join(path, '20210607_152933_Zfront.json'))
datasets['points_axis_z2'] = compas.json_load(os.path.join(path, '20210607_152425_Zback.json'))

datasets['J1_armdown'] = compas.json_load(os.path.join(path, '20210607_163105_J1_armdown.json'))
datasets['J1_armfront'] = compas.json_load(os.path.join(path, '20210607_163724_J1_armfront.json'))
datasets['J1_armback'] = compas.json_load(os.path.join(path, '20210607_164532_J1_armback.json'))
datasets['J2_Z4800_base'] = compas.json_load(os.path.join(path, '20210607_155103_J2_Base_FullExtend_Z-4800.json'))
datasets['J2_Z4800_tool'] = compas.json_load(os.path.join(path, '20210607_160318_J2_Tool_FullExtend_Z-4800.json'))
datasets['J2_Z3700_base'] = compas.json_load(os.path.join(path, '20210607_154630_J2_Base_FullExtend_Z-3700.json'))
datasets['J2_Z3700_tool'] = compas.json_load(os.path.join(path, '20210607_155914_J2_Tool_FullExtend_Z-3700.json'))

datasets['J3_armdown'] = compas.json_load(os.path.join(path, '20210607_161315_J3_armdown.json'))
datasets['J3_armback'] = compas.json_load(os.path.join(path, '20210607_161922_J3_armback.json'))
datasets['J3_armfront'] = compas.json_load(os.path.join(path, '20210607_162546_J3_armfront.json'))

quality_threshold = 12

#data = [Point3d(*pt['igps_frame_39'].origin) for pt in datasets['J1_armdown'] if pt['igps_frame_39'].quality >= quality_threshold]
joint_types = [Joint.PRISMATIC] * 3 + [Joint.REVOLUTE] * 6
joint_names = [
    "bridge1_joint_EA_X", 
    "robot11_joint_EA_Y", 
    "robot11_joint_EA_Z",
    "robot11_joint_1",
    "robot11_joint_2",
    "robot11_joint_3",
    "robot11_joint_4",
    "robot11_joint_5",
    "robot11_joint_6"]
    
configurations = []
sensor_39_points = []
sensor_59_points = []
for pt in datasets[dataset_name]:
    if pt['igps_frame_39'].quality >= quality_threshold and pt['igps_frame_59'].quality >= quality_threshold:
        ext_values = [x * 0.001 for x in pt['robot_external_axes'][:3]]
        robot_values = to_radians(pt['robot_joints'])
        configuration = Configuration(ext_values + robot_values, joint_types, joint_names)
        configurations.append(configuration)
        sensor_39_points.append(Point3d(*pt['igps_frame_39'].origin)*(0.001))
        sensor_59_points.append(Point3d(*pt['igps_frame_59'].origin)*(0.001))
# ---------- end python_4 ----------
panel_3 = Panel(ghpython_script_2.out)
python_5 = GhPythonScript(path=panel_2, dataset_name=list, sensor_name=list_5)  # -> out, configurations, points; disabled
# ---------- python_5: Python ----------
import compas
import rfl_toolbox
import os
import rhinoscriptsyntax as rs
from Rhino.Geometry import Point3d
from compas.robots import Configuration, Joint
from compas_fab.robots import to_radians
# Data sets
datasets = {}
points_axis_xy_rectangle = compas.json_load(os.path.join(path, '20210601_193837_XY.json'))
datasets['points_axis_x1'] = points_axis_xy_rectangle[0]
datasets['points_axis_y1'] = points_axis_xy_rectangle[1]
datasets['points_axis_x2'] = points_axis_xy_rectangle[2]
datasets['points_axis_y2'] = points_axis_xy_rectangle[3]
datasets['points_axis_z1'] = compas.json_load(os.path.join(path, '20210607_152933_Zfront.json'))
datasets['points_axis_z2'] = compas.json_load(os.path.join(path, '20210607_152425_Zback.json'))

datasets['J1_armdown'] = compas.json_load(os.path.join(path, '20210607_163105_J1_armdown.json'))
datasets['J1_armfront'] = compas.json_load(os.path.join(path, '20210607_163724_J1_armfront.json'))
datasets['J1_armback'] = compas.json_load(os.path.join(path, '20210607_164532_J1_armback.json'))
datasets['J2_Z4800_base'] = compas.json_load(os.path.join(path, '20210607_155103_J2_Base_FullExtend_Z-4800.json'))
datasets['J2_Z4800_tool'] = compas.json_load(os.path.join(path, '20210607_160318_J2_Tool_FullExtend_Z-4800.json'))
datasets['J2_Z3700_base'] = compas.json_load(os.path.join(path, '20210607_154630_J2_Base_FullExtend_Z-3700.json'))
datasets['J2_Z3700_tool'] = compas.json_load(os.path.join(path, '20210607_155914_J2_Tool_FullExtend_Z-3700.json'))

datasets['J3_armdown'] = compas.json_load(os.path.join(path, '20210607_161315_J3_armdown.json'))
datasets['J3_armback'] = compas.json_load(os.path.join(path, '20210607_161922_J3_armback.json'))
datasets['J3_armfront'] = compas.json_load(os.path.join(path, '20210607_162546_J3_armfront.json'))

quality_threshold = 12

#data = [Point3d(*pt['igps_frame_39'].origin) for pt in datasets['J1_armdown'] if pt['igps_frame_39'].quality >= quality_threshold]
joint_types = [Joint.PRISMATIC] * 3 + [Joint.REVOLUTE] * 6
joint_names = [
    "bridge1_joint_EA_X", 
    "robot11_joint_EA_Y", 
    "robot11_joint_EA_Z",
    "robot11_joint_1",
    "robot11_joint_2",
    "robot11_joint_3",
    "robot11_joint_4",
    "robot11_joint_5",
    "robot11_joint_6"]
    
configurations = []
for pt in datasets[dataset_name]:
    if pt[sensor_name].quality >= quality_threshold:
        ext_values = [x * 0.001 for x in pt['robot_external_axes'][:3]]
        robot_values = to_radians(pt['robot_joints'])
        configuration = Configuration(ext_values + robot_values, joint_types, joint_names)
        configurations.append(configuration)

points = [Point3d(*pt[sensor_name].origin)*(0.001) for pt in datasets[dataset_name] if pt[sensor_name].quality >= quality_threshold]
# ---------- end python_5 ----------
robot11_joint_ea_z = Slider(-3.9, range=-5..0)
ln = Line(StartPoint=python_4.sensor_39_points, EndPoint=python_4.sensor_59_points)
midpt = CurveMiddle(Curve=ln)
panel_4 = Panel("""robot22
robot11_eaXYZ
robot21_eaXYZ
robot11_eaYZ
robot11
robot21_eaYZ
robot12
robot12_eaYZ
robot11_gantry
robot22_eaYZ
robot21""")
configuration_change = GhPythonScript(robot=robot, bridge1_joint_EA_X=Slider(0, range=0..10), robot11_joint_EA_Z=robot11_joint_ea_z)  # -> out, configuration
# ---------- configuration_change: Python ----------
configuration = robot.zero_configuration()
configuration['bridge1_joint_EA_X'] = bridge1_joint_EA_X
configuration['robot11_joint_EA_Z'] = robot11_joint_EA_Z
print (configuration)
# ---------- end configuration_change ----------
pline = PolyLine(Vertices=midpt, Closed=False)
list_6 = ValueList({"robot22", "robot11_eaXYZ", "robot21_eaXYZ", "robot11_eaYZ", "robot11", "robot21_eaYZ", "robot12", "robot12_eaYZ", "robot11_gantry", "robot22_eaYZ", "robot21"}, selected="robot11_eaXYZ")
list_7 = ValueList({"robot22", "robot11_eaXYZ", "robot21_eaXYZ", "robot11_eaYZ", "robot11", "robot21_eaYZ", "robot12", "robot12_eaYZ", "robot11_gantry", "robot22_eaYZ", "robot21"}, selected="robot11_gantry")
python_6 = GhPythonScript(robot=robot)  # -> out, a
# ---------- python_6: Python ----------
print robot.zero_configuration
# ---------- end python_6 ----------
visualize = PythonScript(robot=python_3.robot_out, group=list_6, configuration=python_4.configurations)  # -> frame
# ---------- visualize: Python ----------
from __future__ import print_function
from compas.geometry import Frame
from compas_ghpython import draw_frame

configuration = robot.zero_configuration().merged(configuration)

joint_names = [joint.name for joint in robot.model.iter_joints()]

if robot and configuration:
    group = group or robot.main_group_name
    robot.update(configuration, group, visual=False, collision=False)
    frame = robot.forward_kinematics(configuration, group)
    frame = draw_frame(Frame.from_data(frame.data))
# ---------- end visualize ----------
visualize_2 = PythonScript(robot=python_3.robot_out, group=list_7, configuration=python_4.configurations)  # -> frame; same code as visualize
item = ListItem(List=python_4.configurations, Index=0, Wrap=True)  # -> Item1, Item
vec2pt = Vector2Pt(PointA=visualize_2, PointB=midpt, Unitize=False)  # -> Vector, Length
panel_5 = Panel(vec2pt.Vector)
dist = Distance(PointA=visualize_2, PointB=midpt)

# ----
# Robot Visualisation
# Global XYZ offset to align Robot origin and iGPS origin:
# world_joint
# 
# Robot 11 Gantry Z column tilt:
# - joint: robot11_joint_EA_Z (rpy 2nd 3rd value)
# 
# Adjusting the origin of robot11_base (The Gantry Z Link):
# - joint: robot11_joint_EA_Z (origin Z = 5)
# - joint: robot11_joint_0 (origin Z = -5)
# - link: robot11_base (visual and collision geometry origin Z -5)
show_end_effector_frame = BooleanToggle(True)
show_base_frame = BooleanToggle(False)
show_collision = BooleanToggle(True)
show_frames = BooleanToggle(True)
show_visual = BooleanToggle(True)
visualize_3 = PythonScript(
    robot=python_3.robot_out,
    group="robot11_eaXYZ",
    configuration=configuration_change.configuration,
    show_visual=show_visual,
    show_collision=show_collision,
    show_frames=show_frames,
    show_base_frame=show_base_frame,
    show_end_effector_frame=show_end_effector_frame)  # -> out, link_names, joint_names, visual, collision, frames, ee_frame, base_frame
# ---------- visualize_3: Python ----------
"""Visualizes a robot.
    Inputs:
        robot: The robot
        configuration: :class:`compas_fab.robots.Configuration`
            The robot's full configuration to display.
        show_visual: bool
           Whether or not to show the robot's visual meshes.
        show_collision: bool
           Whether or not to show the robot's collision meshes.
        show_frames: bool
           Whether or not to show the robot's joint frames.
        show_base_frame: bool
           Whether or not to show the robot's base frame.
        show_end_effector_frame: bool
            Whether or not to show the robot's end-effector frame.
    Output:
        visual: The robot's visual meshes.
        collision: The robot's collision meshes.
        frames: The robot's joint frames.
        base_frame: The robot's base frame.
        ee_frame: The robot's end-effector frame.
"""
from __future__ import print_function
from compas.geometry import Frame
print (robot.group_names)

if not configuration:
    configuration = robot.zero_configuration()
else:
    configuration = robot.zero_configuration().merged(configuration)
    
if robot and configuration:
    group = group or robot.main_group_name
    robot.update(configuration, group, visual=show_visual, collision=show_collision)
    print(robot.get_end_effector_link_name(group))
    if show_visual:
        visual = robot.artist.draw_visual()

    if show_collision:
        collision = robot.artist.draw_collision()

    if show_frames:
        axes = robot.transformed_axes(configuration, group)
        frames = robot.transformed_frames(configuration, group)

    if show_base_frame:
        frames = robot.transformed_frames(configuration, group)
        base_frame = frames[0]

    if show_end_effector_frame:
        ee_frame = robot.forward_kinematics(configuration, group)
        ee_frame = Frame.from_data(ee_frame.data)
        
        print ("End-effector", ee_frame)
link_names = []
for link in robot.model.iter_links():
    for item in getattr(link, 'visual'):
        link_names.append (link.name)
        
joint_names = [joint.name for joint in robot.model.iter_joints()]
print (frames)
# ---------- end visualize_3 ----------
number_slider_3 = Slider(1, range=0..1)
python_7 = GhPythonScript(frame=visualize_3.ee_frame)  # -> out, plane
# ---------- python_7: Python ----------
from compas_ghpython import draw_frame
plane = draw_frame(frame)
# ---------- end python_7 ----------
draw = GhPythonScript(frames=visualize_3.ee_frame, scale=number_slider_3)  # -> P, V, C, W, flatten(planes); inputs frames: list
# ---------- draw: Python ----------
from System.Drawing import Color
from compas_ghpython import draw_frame

red = Color.FromArgb(255, 0, 0)
green = Color.FromArgb(0, 255, 0)
blue = Color.FromArgb(0, 0, 255)

P = []
V = []
C = []
planes = []

scale = float(scale)

for frame in frames:
    if not frame:
        continue
    plane = draw_frame(frame)
    P += [plane.Origin] * 3
    V.append(plane.XAxis * scale)
    V.append(plane.YAxis * scale)
    V.append(plane.ZAxis * scale)
    C += [red, green, blue]
    planes.append(plane)

W = 3
# ---------- end draw ----------
scale = Scale(Geometry=draw.P, Center=Point(0, 0, 0), Factor=1000)  # -> Geometry, Transform
scale_2 = Scale(Geometry=python_7.plane, Center=Point(0, 0, 0), Factor=1000)  # -> Geometry, Transform
vector_display_ex = VectorDisplayEx(Point=draw.P, Vector=draw.V, Colour=draw.C, Width=draw.W)
panel_6 = Panel(scale_2.Geometry)

panel_7 = Panel("robot12_eaYZ")
ln_2 = Line(StartPoint=visualize_2, EndPoint=midpt)
devec = DeconstructVector(Vector=vec2pt.Vector)  # -> graft(XComponent), graft(YComponent), graft(ZComponent)
sqr = Square(Value=flatten(devec.ZComponent))
sqr_2 = Square(Value=flatten(devec.YComponent))
sqrt = SquareRoot(Value=sqr_2)
sqrt_2 = SquareRoot(Value=sqr)
avr = Average(Input=dist)
visualize_4 = PythonScript()  # -> rob_base_frame, ee_frame; disabled
# ---------- visualize_4: Python ----------
from __future__ import print_function
from compas.geometry import Frame
from compas_ghpython import draw_frame

configuration = robot.zero_configuration().merged(configuration)

joint_names = [joint.name for joint in robot.model.iter_joints()]

if robot and configuration:
    group = group or robot.main_group_name
    robot.update(configuration, group, visual=False, collision=False)
    print(robot.get_end_effector_link_name(group))
    
    frames = robot.transformed_frames(configuration, group)
    for joint, frame in zip(robot.model.iter_joints(), frames):
        if joint.name == 'robot11_joint_EA_Z':
            rob_base_frame = draw_frame(Frame.from_data(frame.data))
            print (rob_base_frame)
            
    ee_frame = robot.forward_kinematics(configuration, group)
    ee_frame = draw_frame(Frame.from_data(ee_frame.data))
    
    print ("End-effector", ee_frame)
# ---------- end visualize_4 ----------
ma = MassAddition(Input=[sqrt, sqrt_2])  # -> Result, PartialResults
panel_8 = Panel(ma.Result)
flip = FlipMatrix(Data=[devec.XComponent, devec.YComponent, devec.ZComponent])
avr_2 = Average(Input=flatten(sqr_2))
avr_3 = Average(Input=flatten(sqr))
multiplication = Multiplication(A=flip, B=1000)
graph_mm = QuickGraph(multiplication, SortOrder=0)
panel_9 = Panel(visualize_3.joint_names)
avr_4 = Average(Input=flip)
draw_2 = GhPythonScript(frames=visualize_3.base_frame, scale=number_slider_3)  # -> P, V, C, W, flatten(planes); inputs frames: list; same code as draw
multiplication_2 = Multiplication(A=avr_4, B=1000)
panel_10 = Panel(multiplication_2)
multiplication_3 = Multiplication(A=avr, B=1000)
panel_11 = Panel(multiplication_3)
number_slider_4 = Slider(5, range=0..100)
item_2 = ListItem(List=visualize_3.joint_names, Index=number_slider_4, Wrap=True)
item_3 = ListItem(List=visualize_3.frames, Index=number_slider_4, Wrap=True)
panel_12 = Panel(item_2)
draw_3 = GhPythonScript(frames=visualize_3.frames, scale=number_slider_3)  # -> P, V, C, W, flatten(planes); inputs frames: list; same code as draw
draw_4 = GhPythonScript(frames=item_3, scale=number_slider_3)  # -> P, V, C, W, flatten(planes); inputs frames: list; same code as draw
geo = Geometry(draw.planes)
