# Grasshopper definition 03_rfl_urdf_adjustment_robot11_joint_EA_Z.gh (Grasshopper 1.0.7)

# ----
# Auto-locate repo submodule
rhino_doc_dir = RhinoDocDir()  # -> rhino_doc_dir
# ---------- rhino_doc_dir: Python ----------
import scriptcontext as sc
from os import path

rhino_doc_dir = path.abspath(path.dirname(sc.doc.Path))
# ---------- end rhino_doc_dir ----------
ghpython_script = GhPythonScript(current_path=rhino_doc_dir)  # -> out, path
# ---------- ghpython_script: Python ----------
import os

path = os.path.abspath(os.path.join(current_path, '..','..'))
# ---------- end ghpython_script ----------

path_containing_the_rfl_description_pack = Panel("C:\Users\leungp\Documents\GitHub\integral_timber_joints\external")  # "Path containing the rfl_description package"

path_containing_the_rfl_description_pack_2 = Panel(ghpython_script.path)  # "Path containing the rfl_description package"
rfl_description_package_name = Panel("rfl_description")
urdf_file_name = Panel("rfl_pybullet.urdf")
srdf_file_name = Panel("rfl.srdf")

# ----
# <joint name="robot11_joint_0" type="fixed">
#     <parent link="robot11_base"/>
#     <child link="robot11_base_link"/>
#     <origin rpy="3.14159265359 0 0.0" xyz="0 0 0"/>
#     <dynamics damping="0.2" friction="0"/>
#   </joint>
# Load Robot
load = Button()
ghpython_script_2 = PythonScript(
    load=load,
    pkg_path=path_containing_the_rfl_description_pack_2,
    pkg_name=rfl_description_package_name,
    urdf_file=urdf_file_name,
    srdf_file=srdf_file_name)  # -> out, robot
# ---------- ghpython_script_2: Python ----------
from scriptcontext import sticky as st
import os
import compas

from compas.robots import RobotModel
from compas.robots import GithubPackageMeshLoader
from compas.robots import LocalPackageMeshLoader
from compas_fab.robots import Robot
from compas_fab.robots import RobotSemantics
from compas_ghpython.artists import RobotModelArtist

# Robot meshes are usually in meters
# Set a high percision to prevent parsing errors
# and configure Rhino itself in meters
compas.PRECISION = '12f'

# Store robot in component-based key
robot_key = 'robot_{}'.format(str(ghenv.Component.InstanceGuid))

if robot_key not in st:
    st[robot_key] = None

if load:
    # Also load geometry
    loader = LocalPackageMeshLoader(os.path.join(pkg_path, 'rfl_description'), pkg_name)
    abb_loader = LocalPackageMeshLoader(os.path.join(pkg_path), "abb_irb4600_40_255")
    
    # Create robot model from URDF
    model = RobotModel.from_urdf_string(loader.load_urdf(urdf_file).read())
    model.load_geometry(loader, abb_loader)

    artist = RobotModelArtist(model)
    
    robot_semantics = None
    if srdf_file:
        robot_semantics = RobotSemantics.from_srdf_file(loader.build_path('urdf', srdf_file), model)
    
    robot = Robot(model, artist, semantics=robot_semantics)
#    robot.scale(1000)
    st[robot_key] = robot

robot = st[robot_key]

#repo    = 'ros-industrial/abb'
#package = 'abb_irb6600_support'
#branch  = 'kinetic-devel'
#
#github = GithubPackageMeshLoader(repo, package, branch)
#
#model = RobotModel.from_urdf_file(github.load_urdf('irb6640.urdf'))
#model.load_geometry(github)
#artist = RobotModelArtist(model)
#robot = Robot(model, artist)
# ---------- end ghpython_script_2 ----------
robot = Data(ghpython_script_2.robot)

# ----
# Load Robot
load_2 = Button()
ghpython_script_3 = PythonScript(
    load=load_2,
    pkg_path=path_containing_the_rfl_description_pack_2,
    pkg_name=rfl_description_package_name,
    urdf_file=urdf_file_name,
    srdf_file=srdf_file_name)  # -> out, robot; same code as ghpython_script_2
robot_2 = Data(ghpython_script_3.robot)

# ----
# Load Robot
load_3 = Button()
ghpython_script_4 = PythonScript(
    load=load_3,
    pkg_path=path_containing_the_rfl_description_pack_2,
    pkg_name=rfl_description_package_name,
    urdf_file=urdf_file_name,
    srdf_file=srdf_file_name)  # -> out, robot; same code as ghpython_script_2
robot_3 = Data(ghpython_script_4.robot)

# ----
# Development Tools
# Reload Python Modules (if Module Code is Changed)
python_module_to_reload = Panel("""compas
compas_fab
roslibpy
integral_timber_joints""")
reload = Button()
py = PythonScript(reload_module_button=reload, module_names=python_module_to_reload)  # inputs module_names: list
# ---------- py: Python ----------
import compas_ghpython
from compas_ghpython import unload_modules
if reload_module_button:
    for module in module_names:
        unload_modules(module)
# ---------- end py ----------

# ----
# Check Path and Environment
compas_version = GhPythonScript()  # -> out, compas_version, compas_fab_version, compas_path, compas_fab_path, compas_env_name, python_directory
# ---------- compas_version: Python ----------
__author__ = "leungp"
__version__ = "2020.04.20"

import rhinoscriptsyntax as rs
import compas
import compas_fab
compas_version  = compas.__version__
compas_fab_version = compas_fab.__version__
import os
compas_path = os.path.abspath(compas.__file__)
compas_fab_path = os.path.abspath(compas_fab.__file__)

import compas_bootstrapper
compas_env_name = compas_bootstrapper.ENVIRONMENT_NAME
python_directory = compas_bootstrapper.PYTHON_DIRECTORY
# ---------- end compas_version ----------
# <joint name="world_joint" type="fixed">
#     <parent link="world"/>
#     <child link="x_rail"/>
#     <origin rpy="0.0 0.0 0.0" xyz="0.0 0.0 0.0"/>
#   </joint>
compas_environment_name = Panel(compas_version.compas_env_name)
compas_version_2 = Panel(compas_version.compas_version)
compas_fab_version = Panel(compas_version.compas_fab_version)
compas_path = Panel(compas_version.compas_path)
compas_fab_path = Panel(compas_version.compas_fab_path)
python_directory = Panel(compas_version.python_directory)

python = GhPythonScript(
    robot=robot_3,
    joint_name="world_joint",
    x=Slider(2.615341, range=-1..3),
    y=Slider(2.06001, range=-1..3),
    z=Slider(-0.035107, range=-1..1),
    u=Slider(0, range=-0.05..0.05),
    v=Slider(0, range=-0.05..0.05),
    w=Slider(0, range=-0.05..0.05))  # -> out, robot_out
# ---------- python: Python ----------
from compas.robots import Origin
from compas.geometry import Transformation
from copy import deepcopy

attributes = {'xyz': '%f %f %f' % (x,y,z), 'rpy': '%f %f %f' % (u,v,w)}
print attributes
joint = robot.get_joint_by_name(joint_name)
joint.origin = Origin.from_urdf(attributes, [], None)

robot.model._create(robot.model.root, Transformation())
robot_out = robot
# ---------- end python ----------

number_slider = Slider(-0.00034, range=-0.05..0.05)
list = ValueList({"points_axis_x1", "points_axis_x2", "points_axis_y1", "points_axis_y2", "points_axis_z1", "points_axis_z2", "J1_armdown", "J1_armfront", "J1_armback", "J2_Z4800_base", "J2_Z4800_tool", "J2_Z3700_base", "J2_Z3700_tool", "J3_armdown", "J3_armback", "J3_armfront"}, selected="J1_armfront")
list_2 = ValueList({"points_axis_x1", "points_axis_x2", "points_axis_y1", "points_axis_y2", "points_axis_z1", "points_axis_z2", "J1_armdown", "J1_armfront", "J1_armback", "J2_Z4800_base", "J2_Z4800_tool", "J2_Z3700_base", "J2_Z3700_tool", "J3_armdown", "J3_armback", "J3_armfront"}, selected="J1_armdown")
list_3 = ValueList({"points_axis_x1", "points_axis_x2", "points_axis_y1", "points_axis_y2", "points_axis_z1", "points_axis_z2", "J1_armdown", "J1_armfront", "J1_armback", "J2_Z4800_base", "J2_Z4800_tool", "J2_Z3700_base", "J2_Z3700_tool", "J3_armdown", "J3_armback", "J3_armfront"}, selected="J1_armback")
# <joint name="robot11_joint_EA_Z" type="prismatic">
#     <parent link="robot11_xy_cart"/>
#     <child link="robot11_base"/>
#     <origin rpy="0 0 0 " xyz="0 0 0"/>
#     <axis xyz="0 0 -1"/>
#     <limit effort="100000" lower="-4.915" upper="-1.005" velocity="2.618"/>
#     <dynamics damping="0.2" friction="0"/>
#   </joint>
panel = Panel("C:\Users\leungp\Documents\GitHub\rfl_toolbox\collected_data")
python_2 = GhPythonScript(
    robot=robot,
    joint_name="world_joint",
    x=Slider(2.620341, range=-1..3),
    y=Slider(2.06001, range=-1..3),
    z=Slider(-0.041607, range=-1..1),
    u=Slider(-3.5e-05, range=-0.05..0.05),
    v=Slider(-3.5e-05, range=-0.05..0.05),
    w=Slider(1.5e-05, range=-0.05..0.05))  # -> out, robot_out; same code as python
python_3 = GhPythonScript(
    robot=python_2.robot_out,
    joint_name="robot11_joint_EA_Z",
    x=Slider(0, range=-1..1),
    y=Slider(0, range=-1..1),
    z=Slider(0, range=-1..1),
    u=Slider(0, range=-0.05..0.05),
    v=Slider(-0.00155, range=-0.05..0.05),
    w=Slider(0, range=-0.05..0.05))  # -> out, robot_out
# ---------- python_3: Python ----------
from compas.robots import Origin
from compas.geometry import Transformation

attributes = {'xyz': '%f %f %f' % (x,y,z), 'rpy': '%f %f %f' % (u,v,w)}
print attributes
joint = robot.get_joint_by_name(joint_name)
joint.origin = Origin.from_urdf(attributes, [], None)

robot.model._create(robot.model.root, Transformation())
robot_out = robot
# ---------- end python_3 ----------
python_4 = GhPythonScript(
    robot=python_3.robot_out,
    joint_name="robot11_joint_0",
    x=Slider(5.4e-05, range=-1..1),
    y=Slider(-0.000488, range=-1..1),
    z=Slider(0.005795, range=-1..1),
    u=Slider(3.14159265, range=0..10),
    v=Slider(0, range=-0.05..0.05),
    w=number_slider)  # -> out, robot_out; same code as python_3
list_4 = ValueList({"points_axis_x1", "points_axis_x2", "points_axis_y1", "points_axis_y2", "points_axis_z1", "points_axis_z2", "J1_armdown", "J1_armfront", "J1_armback", "J2_Z4800_base", "J2_Z4800_tool", "J2_Z3700_base", "J2_Z3700_tool", "J3_armdown", "J3_armback", "J3_armfront"}, selected="J2_Z4800_tool")
list_5 = ValueList({"points_axis_x1", "points_axis_x2", "points_axis_y1", "points_axis_y2", "points_axis_z1", "points_axis_z2", "J1_armdown", "J1_armfront", "J1_armback", "J2_Z4800_base", "J2_Z4800_tool", "J2_Z3700_base", "J2_Z3700_tool", "J3_armdown", "J3_armback", "J3_armfront"}, selected="J2_Z3700_tool")
list_6 = ValueList({"points_axis_x1", "points_axis_x2", "points_axis_y1", "points_axis_y2", "points_axis_z1", "points_axis_z2", "J1_armdown", "J1_armfront", "J1_armback", "J2_Z4800_base", "J2_Z4800_tool", "J2_Z3700_base", "J2_Z3700_tool", "J3_armdown", "J3_armback", "J3_armfront"}, selected="J3_armdown")
list_7 = ValueList({"points_axis_x1", "points_axis_x2", "points_axis_y1", "points_axis_y2", "points_axis_z1", "points_axis_z2", "J1_armdown", "J1_armfront", "J1_armback", "J2_Z4800_base", "J2_Z4800_tool", "J2_Z3700_base", "J2_Z3700_tool", "J3_armdown", "J3_armback", "J3_armfront"}, selected="J3_armback")
list_8 = ValueList({"points_axis_x1", "points_axis_x2", "points_axis_y1", "points_axis_y2", "points_axis_z1", "points_axis_z2", "J1_armdown", "J1_armfront", "J1_armback", "J2_Z4800_base", "J2_Z4800_tool", "J2_Z3700_base", "J2_Z3700_tool", "J3_armdown", "J3_armback", "J3_armfront"}, selected="J3_armfront")
measured_data = GhPythonScript(path=panel, dataset_name=[list_6, list_7, list_8, list, list_2, list_3, list_4, list_5])  # -> out, flatten(configurations), flatten(sensor_39_points), flatten(sensor_59_points)
# ---------- measured_data: Python ----------
import compas
import rfl_toolbox
import os
import rhinoscriptsyntax as rs
from Rhino.Geometry import Point3d
from compas.robots import Configuration, Joint
from compas_fab.robots import to_radians
# Data sets
datasets = {}
points_axis_xy_rectangle = compas.json_load(os.path.join(path, '20210601_193837_XY.json'))
datasets['points_axis_x1'] = points_axis_xy_rectangle[0]
datasets['points_axis_y1'] = points_axis_xy_rectangle[1]
datasets['points_axis_x2'] = points_axis_xy_rectangle[2]
datasets['points_axis_y2'] = points_axis_xy_rectangle[3]
datasets['points_axis_z1'] = compas.json_load(os.path.join(path, '20210607_152933_Zfront.json'))
datasets['points_axis_z2'] = compas.json_load(os.path.join(path, '20210607_152425_Zback.json'))

datasets['J1_armdown'] = compas.json_load(os.path.join(path, '20210607_163105_J1_armdown.json'))
datasets['J1_armfront'] = compas.json_load(os.path.join(path, '20210607_163724_J1_armfront.json'))
datasets['J1_armback'] = compas.json_load(os.path.join(path, '20210607_164532_J1_armback.json'))
datasets['J2_Z4800_base'] = compas.json_load(os.path.join(path, '20210607_155103_J2_Base_FullExtend_Z-4800.json'))
datasets['J2_Z4800_tool'] = compas.json_load(os.path.join(path, '20210607_160318_J2_Tool_FullExtend_Z-4800.json'))
datasets['J2_Z3700_base'] = compas.json_load(os.path.join(path, '20210607_154630_J2_Base_FullExtend_Z-3700.json'))
datasets['J2_Z3700_tool'] = compas.json_load(os.path.join(path, '20210607_155914_J2_Tool_FullExtend_Z-3700.json'))

datasets['J3_armdown'] = compas.json_load(os.path.join(path, '20210607_161315_J3_armdown.json'))
datasets['J3_armback'] = compas.json_load(os.path.join(path, '20210607_161922_J3_armback.json'))
datasets['J3_armfront'] = compas.json_load(os.path.join(path, '20210607_162546_J3_armfront.json'))

quality_threshold = 12

#data = [Point3d(*pt['igps_frame_39'].origin) for pt in datasets['J1_armdown'] if pt['igps_frame_39'].quality >= quality_threshold]
joint_types = [Joint.PRISMATIC] * 3 + [Joint.REVOLUTE] * 6
joint_names = [
    "bridge1_joint_EA_X", 
    "robot11_joint_EA_Y", 
    "robot11_joint_EA_Z",
    "robot11_joint_1",
    "robot11_joint_2",
    "robot11_joint_3",
    "robot11_joint_4",
    "robot11_joint_5",
    "robot11_joint_6"]
    
configurations = []
sensor_39_points = []
sensor_59_points = []
for pt in datasets[dataset_name]:
    if pt['igps_frame_39'].quality >= quality_threshold and pt['igps_frame_59'].quality >= quality_threshold:
        ext_values = [x * 0.001 for x in pt['robot_external_axes'][:3]]
        robot_values = to_radians(pt['robot_joints'])
        configuration = Configuration(ext_values + robot_values, joint_types, joint_names)
        configurations.append(configuration)
        sensor_39_points.append(Point3d(*pt['igps_frame_39'].origin)*(0.001))
        sensor_59_points.append(Point3d(*pt['igps_frame_59'].origin)*(0.001))
# ---------- end measured_data ----------
panel_2 = Panel(ghpython_script_2.out)
robot11_joint_ea_z = Slider(-3.9, range=-5..0)
ln = Line(StartPoint=measured_data.sensor_39_points, EndPoint=measured_data.sensor_59_points)
galapagos = Galapagos(fitness=ma, gene=number_slider)
midpt = CurveMiddle(Curve=ln)
pline = PolyLine(Vertices=midpt, Closed=False)
# Global XYZ offset to align Robot origin and iGPS origin:
# world_joint
# 
# Robot 11 Gantry Z column tilt:
# - joint: robot11_joint_EA_Z (rpy 2nd 3rd value)
# 
# Adjusting the origin of robot11_base (The Gantry Z Link):
# - joint: robot11_joint_EA_Z (origin Z = 5)
# - joint: robot11_joint_0 (origin Z = -5)
# - link: robot11_base (visual and collision geometry origin Z -5)
panel_3 = Panel("""robot22
robot11_eaXYZ
robot21_eaXYZ
robot11_eaYZ
robot11
robot21_eaYZ
robot12
robot12_eaYZ
robot11_gantry
robot22_eaYZ
robot21""")
configuration_change = GhPythonScript(robot=robot, bridge1_joint_EA_X=Slider(0, range=0..10), robot11_joint_EA_Z=robot11_joint_ea_z)  # -> out, configuration
# ---------- configuration_change: Python ----------
configuration = robot.zero_configuration()
configuration['bridge1_joint_EA_X'] = bridge1_joint_EA_X
configuration['robot11_joint_EA_Z'] = robot11_joint_EA_Z
print (configuration)
# ---------- end configuration_change ----------
galapagos_2 = Galapagos(fitness=sqr, gene=[number_slider_7, number_slider_6, number_slider_5])
list_9 = ValueList({"robot22", "robot11_eaXYZ", "robot21_eaXYZ", "robot11_eaYZ", "robot11", "robot21_eaYZ", "robot12", "robot12_eaYZ", "robot11_gantry", "robot22_eaYZ", "robot21"}, selected="robot11_eaXYZ")
python_5 = GhPythonScript(robot=robot)  # -> out, a
# ---------- python_5: Python ----------
print robot.zero_configuration
# ---------- end python_5 ----------
list_10 = ValueList({"robot22", "robot11_eaXYZ", "robot21_eaXYZ", "robot11_eaYZ", "robot11", "robot21_eaYZ", "robot12", "robot12_eaYZ", "robot11_gantry", "robot22_eaYZ", "robot21"}, selected="robot11_gantry")
ik = PythonScript(robot=python_4.robot_out, group=list_10, configuration=measured_data.configurations)  # -> frame
# ---------- ik: Python ----------
from __future__ import print_function
from compas.geometry import Frame
from compas_ghpython import draw_frame

configuration = robot.zero_configuration().merged(configuration)

joint_names = [joint.name for joint in robot.model.iter_joints()]

if robot and configuration:
    group = group or robot.main_group_name
    robot.update(configuration, group, visual=False, collision=False)
    frame = robot.forward_kinematics(configuration, group)
    frame = draw_frame(Frame.from_data(frame.data))
# ---------- end ik ----------
ik_2 = PythonScript(robot=python_4.robot_out, group=list_9, configuration=measured_data.configurations)  # -> frame; same code as ik
number_slider_2 = Slider(0.07125, range=-0.2..0.2)
number_slider_3 = Slider(-0.09957, range=-0.2..0.2)
number_slider_4 = Slider(-0.00022, range=-0.1..0.1)
item = ListItem(List=measured_data.configurations, Index=0, Wrap=True)  # -> Item1, Item
number_slider_5 = Slider(0.06302, range=-0.2..0.2)
number_slider_6 = Slider(-0.09709, range=-0.2..0.2)
number_slider_7 = Slider(0.00024, range=-0.1..0.1)

list_11 = ValueList({"robot22", "robot11_eaXYZ", "robot21_eaXYZ", "robot11_eaYZ", "robot11", "robot21_eaYZ", "robot12", "robot12_eaYZ", "robot11_gantry", "robot22_eaYZ", "robot21"}, selected="robot11_eaXYZ")
ik_3 = PythonScript(robot=python.robot_out, group=list_11, configuration=measured_data.configurations)  # -> frame; same code as ik
plcoord = PlaneCoordinates(Point=midpt, System=ik_3)  # -> XCoordinate, YCoordinate, ZCoordinate
avr = Average(Input=plcoord.XCoordinate)
avr_2 = Average(Input=plcoord.YCoordinate)
avr_3 = Average(Input=plcoord.ZCoordinate)
pt = PointOriented(BasePlane=ik_3, UComponent=number_slider_7, VComponent=number_slider_6, WComponent=number_slider_5)
vec2pt = Vector2Pt(PointA=pt, PointB=midpt, Unitize=False)  # -> Vector, Length
ln_2 = Line(StartPoint=pt, EndPoint=midpt)
dist = Distance(PointA=pt, PointB=midpt)
multiplication = Multiplication(A=vec2pt.Vector, B=1000)
avr_4 = Average(Input=dist)
devec = DeconstructVector(Vector=multiplication)  # -> graft(XComponent), graft(YComponent), graft(ZComponent)
multiplication_2 = Multiplication(A=avr_4, B=1000)
flip = FlipMatrix(Data=[devec.XComponent, devec.YComponent, devec.ZComponent])
abs = Absolute(Value=flip)
avr_5 = Average(Input=flip)
avr_6 = Average(Input=abs)

# ----
# Uncalibrated URDF
# (Using new igps Offset)
average_deviation_mm = Panel(multiplication_2)
average_deviation = Panel(avr_6)
center_point_drift = Panel(avr_5)
graph_mm = QuickGraph(flip, SortOrder=0)
panel_4 = Panel(multiplication)

# ----
# Robot Visualisation
show_end_effector_frame = BooleanToggle(True)
show_base_frame = BooleanToggle(False)
show_collision = BooleanToggle(True)
show_frames = BooleanToggle(True)
show_visual = BooleanToggle(True)
visualize = PythonScript(
    robot=python_4.robot_out,
    group="robot11_eaXYZ",
    configuration=configuration_change.configuration,
    show_visual=show_visual,
    show_collision=show_collision,
    show_frames=show_frames,
    show_base_frame=show_base_frame,
    show_end_effector_frame=show_end_effector_frame)  # -> out, link_names, joint_names, visual, collision, frames, ee_frame, base_frame
# ---------- visualize: Python ----------
"""Visualizes a robot.
    Inputs:
        robot: The robot
        configuration: :class:`compas_fab.robots.Configuration`
            The robot's full configuration to display.
        show_visual: bool
           Whether or not to show the robot's visual meshes.
        show_collision: bool
           Whether or not to show the robot's collision meshes.
        show_frames: bool
           Whether or not to show the robot's joint frames.
        show_base_frame: bool
           Whether or not to show the robot's base frame.
        show_end_effector_frame: bool
            Whether or not to show the robot's end-effector frame.
    Output:
        visual: The robot's visual meshes.
        collision: The robot's collision meshes.
        frames: The robot's joint frames.
        base_frame: The robot's base frame.
        ee_frame: The robot's end-effector frame.
"""
from __future__ import print_function
from compas.geometry import Frame
print (robot.group_names)

if not configuration:
    configuration = robot.zero_configuration()
else:
    configuration = robot.zero_configuration().merged(configuration)
    
if robot and configuration:
    group = group or robot.main_group_name
    robot.update(configuration, group, visual=show_visual, collision=show_collision)
    print(robot.get_end_effector_link_name(group))
    if show_visual:
        visual = robot.artist.draw_visual()

    if show_collision:
        collision = robot.artist.draw_collision()

    if show_frames:
        axes = robot.transformed_axes(configuration, group)
        frames = robot.transformed_frames(configuration, group)

    if show_base_frame:
        frames = robot.transformed_frames(configuration, group)
        base_frame = frames[0]

    if show_end_effector_frame:
        ee_frame = robot.forward_kinematics(configuration, group)
        ee_frame = Frame.from_data(ee_frame.data)
        
        print ("End-effector", ee_frame)
link_names = []
for link in robot.model.iter_links():
    for item in getattr(link, 'visual'):
        link_names.append (link.name)
        
joint_names = [joint.name for joint in robot.model.iter_joints()]
print (frames)
# ---------- end visualize ----------
number_slider_8 = Slider(1, range=0..1)
python_6 = GhPythonScript(frame=visualize.ee_frame)  # -> out, plane
# ---------- python_6: Python ----------
from compas_ghpython import draw_frame
plane = draw_frame(frame)
# ---------- end python_6 ----------
draw = GhPythonScript(frames=visualize.ee_frame, scale=number_slider_8)  # -> P, V, C, W, flatten(planes); inputs frames: list
# ---------- draw: Python ----------
from System.Drawing import Color
from compas_ghpython import draw_frame

red = Color.FromArgb(255, 0, 0)
green = Color.FromArgb(0, 255, 0)
blue = Color.FromArgb(0, 0, 255)

P = []
V = []
C = []
planes = []

scale = float(scale)

for frame in frames:
    if not frame:
        continue
    plane = draw_frame(frame)
    P += [plane.Origin] * 3
    V.append(plane.XAxis * scale)
    V.append(plane.YAxis * scale)
    V.append(plane.ZAxis * scale)
    C += [red, green, blue]
    planes.append(plane)

W = 3
# ---------- end draw ----------
scale = Scale(Geometry=draw.P, Center=Point(0, 0, 0), Factor=1000)  # -> Geometry, Transform
scale_2 = Scale(Geometry=python_6.plane, Center=Point(0, 0, 0), Factor=1000)  # -> Geometry, Transform
vector_display_ex = VectorDisplayEx(Point=draw.P, Vector=draw.V, Colour=draw.C, Width=draw.W)
panel_5 = Panel(scale_2.Geometry)

panel_6 = Panel("robot12_eaYZ")
plcoord_2 = PlaneCoordinates(Point=midpt, System=ik_2)  # -> XCoordinate, YCoordinate, ZCoordinate
avr_7 = Average(Input=plcoord_2.XCoordinate)
avr_8 = Average(Input=plcoord_2.YCoordinate)
avr_9 = Average(Input=plcoord_2.ZCoordinate)
pt_2 = PointOriented(BasePlane=ik_2, UComponent=number_slider_7, VComponent=number_slider_6, WComponent=number_slider_5)
panel_7 = Panel(visualize.joint_names)
pt_3 = Point(pt_2)
vec2pt_2 = Vector2Pt(PointA=pt_3, PointB=midpt, Unitize=False)  # -> Vector, Length
multiplication_3 = Multiplication(A=vec2pt_2.Vector, B=1000)
avr_10 = Average(Input=multiplication_3)
devec_2 = DeconstructVector(Vector=multiplication_3)  # -> graft(XComponent), graft(YComponent), graft(ZComponent)
sqr = Square(Value=devec_2.XComponent)
avr_11 = Average(Input=flatten(sqr))
subtraction = Subtraction(A=avr_11, B=sqr)
abs_2 = Absolute(Value=subtraction)
ma = MassAddition(Input=flatten(abs_2))  # -> Result, PartialResults
ln_3 = Line(StartPoint=pt_3, EndPoint=midpt)
dist_2 = Distance(PointA=pt_3, PointB=midpt)
flip_2 = FlipMatrix(Data=[devec_2.XComponent, devec_2.YComponent, devec_2.ZComponent])
avr_12 = Average(Input=dist_2)
draw_2 = GhPythonScript(frames=visualize.base_frame, scale=number_slider_8)  # -> P, V, C, W, flatten(planes); inputs frames: list; same code as draw
abs_3 = Absolute(Value=flip_2)
avr_13 = Average(Input=flip_2)
avr_14 = Average(Input=abs_3)
multiplication_4 = Multiplication(A=avr_12, B=1000)

# ----
# Calibrated URDF
average_deviation_mm_2 = Panel(multiplication_4)
average_deviation_2 = Panel(avr_14)
center_point_drift_2 = Panel(avr_13)
graph_mm_2 = QuickGraph(flip_2, SortOrder=0)
panel_8 = Panel(multiplication_3)

average_deviation_3 = Panel(ma.Result)
number_slider_9 = Slider(5, range=0..100)
circle_centers_from_j1_swings = Point([Point(24615.02043, 7059.974078, 3344.210555), Point(24615.11476, 7059.671483, 3298.199607), Point(24615.35338, 7060.08024, 3216.094963), Point(24614.81484, 7060.145718, 3217.065588)])
item_2 = ListItem(List=ik, Index=0, Wrap=True)
item_3 = ListItem(List=visualize.joint_names, Index=number_slider_9, Wrap=True)
item_4 = ListItem(List=visualize.frames, Index=number_slider_9, Wrap=True)
deplane = DeconstructPlane(Plane=item_2)  # -> Origin, XAxis, YAxis, ZAxis
multiplication_5 = Multiplication(A=circle_centers_from_j1_swings, B=0.001)
project = Project(Geometry=multiplication_5, Plane=item_2)  # -> Geometry, Transform
panel_9 = Panel(item_3)
draw_3 = GhPythonScript(frames=visualize.frames, scale=number_slider_8)  # -> P, V, C, W, flatten(planes); inputs frames: list; same code as draw
draw_4 = GhPythonScript(frames=item_4, scale=number_slider_8)  # -> P, V, C, W, flatten(planes); inputs frames: list; same code as draw
vec2pt_3 = Vector2Pt(PointA=deplane.Origin, PointB=project.Geometry, Unitize=False)  # -> Vector, Length
devec_3 = DeconstructVector(Vector=vec2pt_3.Vector)  # -> graft(XComponent), graft(YComponent), graft(ZComponent)
flip_3 = FlipMatrix(Data=[devec_3.XComponent, devec_3.YComponent, devec_3.ZComponent])
multiplication_6 = Multiplication(B=1000)
geo = Geometry(draw.planes)
multiplication_7 = Multiplication(A=vec2pt_3.Vector, B=1000)
avr_15 = Average(Input=flip_3)
panel_10 = Panel(avr_15)

list_12 = ValueList({"robot22", "robot11_eaXYZ", "robot21_eaXYZ", "robot11_eaYZ", "robot11", "robot21_eaYZ", "robot12", "robot12_eaYZ", "robot11_gantry", "robot22_eaYZ", "robot21"}, selected="robot11_eaXYZ")
ik_4 = PythonScript(robot=robot_2, group=list_12, configuration=measured_data.configurations)  # -> frame; same code as ik
plcoord_3 = PlaneCoordinates(Point=midpt, System=ik_4)  # -> XCoordinate, YCoordinate, ZCoordinate
avr_16 = Average(Input=plcoord_3.XCoordinate)
avr_17 = Average(Input=plcoord_3.YCoordinate)
avr_18 = Average(Input=plcoord_3.ZCoordinate)
pt_4 = PointOriented(BasePlane=ik_4, UComponent=number_slider_7, VComponent=number_slider_6, WComponent=number_slider_5)

multiplication_8 = Multiplication(A=pt_4, B=1000)
ghpython_script_5 = GhPythonScript(robotworld_points=multiplication_8)  # -> igps_points; inputs robotworld_points: list of Point3d
# ---------- ghpython_script_5: Python ----------
import compas.geometry as cg
import ghpythonlib.components as ghcomp
import Rhino.Geometry as rg
from compas_ghpython import draw_frame



# iGPS world - Robot worls offsets
robot_11_igps_wobj0 = ((-2614.766, -2058.444, 29.420), (1.0, -0.000028, 0.000047, -0.000034))
robot_12_igps_wobj0 = ((-2609.441, -2057.051, 28.106), (1.0, -0.000026, -0.000042, 0.000059))


def transf(obj, rg_T, cg_T):
    if isinstance(obj, rg.Plane):
        return ghcomp.Transform(obj, rg_T)

    elif isinstance(obj, rg.Brep):
        return ghcomp.Transform(obj, rg_T)

    elif isinstance(obj, rg.Mesh):
        return ghcomp.Transform(obj, rg_T)

    elif isinstance(obj, rg.Point3d):
        return ghcomp.Transform(obj, rg_T)

    elif "compas" in str(type(obj)):
        return obj.transformed(cg_T)

    else:
        raise NotImplementedError


def iGPSWorld_to_RobotWorld(obj, robot="robot_11"):

    if robot == "robot_11":
        robot_igps_wobj0 = robot_11_igps_wobj0
    elif robot == "robot_12":
        robot_igps_wobj0 = robot_12_igps_wobj0
    else:
        raise NotImplementedError

    # iGPSworld to RobotWorld transformation
    rg_iGPS_to_robot_world_vector = rg.Vector3d(*robot_igps_wobj0[0])
    
    
    
    
    to_frame = cg.Frame.from_quaternion(robot_11_igps_wobj0[1], point=robot_11_igps_wobj0[0])
    to_plane = draw_frame(to_frame)
    
    rg_iGPS_to_robot_world_T = rg.Transform.PlaneToPlane(rg.Plane.WorldXY, to_plane)
    
    cg_iGPS_to_robot_world_T = None
    """
    cg_iGPS_to_robot_world_T = cg.Transformation.from_matrix([
        [1, 0, 0, rg_iGPS_to_robot_world_vector.X],
        [0, 1, 0, rg_iGPS_to_robot_world_vector.Y],
        [0, 0, 1, rg_iGPS_to_robot_world_vector.Z],
        [0, 0, 0, 1]])
        """

    if isinstance(obj, list):
        # print " --- iGPSWorld_to_RobotWorld for list"
        return [transf(item, rg_iGPS_to_robot_world_T, cg_iGPS_to_robot_world_T) for item in obj]
    elif obj is None:
        # print " --- iGPSWorld_to_RobotWorld for none"
        return None
    else:
        # print " --- iGPSWorld_to_RobotWorld for single object"
        return transf(obj, rg_iGPS_to_robot_world_T, cg_iGPS_to_robot_world_T)


def RobotWorld_to_iGPSWorld(obj, robot="robot_11"):

    if robot == "robot_11":
        robot_igps_wobj0 = robot_11_igps_wobj0
    elif robot == "robot_12":
        robot_igps_wobj0 = robot_12_igps_wobj0
    else:
        raise NotImplementedError

    # RobotWorld to iGPSworld transformation
    rg_robot_world_to_iGPS_vector = -rg.Vector3d(*robot_igps_wobj0[0])
    rg_robot_to_igps_world_T = rg.Transform.Translation(rg_robot_world_to_iGPS_vector)
    cg_robot_to_igps_world_T = cg.Transformation.from_matrix(
        [[1, 0, 0, rg_robot_world_to_iGPS_vector.X],
         [0, 1, 0, rg_robot_world_to_iGPS_vector.Y],
         [0, 0, 1, rg_robot_world_to_iGPS_vector.Z],
         [0, 0, 0, 1]])

    if isinstance(obj, list):
        # print " --- RobotWorld to iGPSworld for list"
        return [transf(item, rg_robot_to_igps_world_T, cg_robot_to_igps_world_T) for item in obj]
    elif obj is None:
        # print " --- RobotWorld to iGPSworld for none"
        return None
    else:
        # print " --- RobotWorld to iGPSworld for single object"
        return transf(obj, rg_robot_to_igps_world_T, cg_robot_to_igps_world_T)

igps_points = RobotWorld_to_iGPSWorld(robotworld_points)
# ---------- end ghpython_script_5 ----------
division = Division(A=ghpython_script_5, B=1000)

vec2pt_4 = Vector2Pt(PointA=division, PointB=midpt, Unitize=False)  # -> Vector, Length
ln_4 = Line(StartPoint=division, EndPoint=midpt)
dist_3 = Distance(PointA=division, PointB=midpt)
multiplication_9 = Multiplication(A=vec2pt_4.Vector, B=1000)
avr_19 = Average(Input=dist_3)
devec_4 = DeconstructVector(Vector=multiplication_9)  # -> graft(XComponent), graft(YComponent), graft(ZComponent)
multiplication_10 = Multiplication(A=avr_19, B=1000)
flip_4 = FlipMatrix(Data=[devec_4.XComponent, devec_4.YComponent, devec_4.ZComponent])
abs_4 = Absolute(Value=flip_4)
avr_20 = Average(Input=flip_4)
avr_21 = Average(Input=abs_4)

# ----
# Uncalibrated URDF
# (Using old igps Offset)
average_deviation_mm_3 = Panel(multiplication_10)
average_deviation_4 = Panel(avr_21)
center_point_drift_3 = Panel(avr_20)

graph_mm_3 = QuickGraph(flip_4, SortOrder=0)
